# Dynamo graph KEO_D4_ShaftCheck.dyn "KEO D4 - Shaft review" (Dynamo 4.2.1.5887)
# author: keo-calc
# Read-only saved profile, above-aperture candidates and existing RoomTag types. No acceptance or model writes.

config_json_path_local_only = StringInput("")  # graph input
read_test_rvt_false_cancel = BoolSelector(false)  # graph input
run_number_change_to_repeat = IntegerSlider(0, range=0..1000 step 1)  # graph input
d4_shaft_review = Python(IN[0]=config_json_path_local_only, IN[1]=read_test_rvt_false_cancel, IN[2]=run_number_change_to_repeat)  # PythonNet3
# ---------- d4_shaft_review.python (1449 lines) ----------
BUNDLE_SHA256 = "b461d4211c2083b443e53f0c50860ed163f5e8d9f830affa88cb4f5f96b241ed"
"""D0: read-only environment probe for Dynamo PythonNet3. No model writes.

IN: absolute config JSON path, enabled Boolean, run nonce (change to rerun).
OUT: JSON evidence. Configuration and runtime evidence are private local files.
"""
import datetime
import json
import ntpath
import os
import re
import sys
import uuid

PROBE_VERSION = "0.1.0"
SOURCE_SHA256 = globals().get("SOURCE_SHA256", "unbundled")


class ProbeRefused(Exception):
    pass


def canonical_path(value, extension):
    if not isinstance(value, str) or not ntpath.isabs(value):
        raise ProbeRefused("An absolute local path is required")
    path = ntpath.normpath(value)
    if path.startswith("\\\\") or ntpath.splitext(path)[1].lower() != extension:
        raise ProbeRefused("Wrong file extension or non-local path")
    return ntpath.normcase(path)


def validate_config(config):
    required = {"schema", "expected_rvt_path", "expected_sha256", "expected_revit_version", "expected_revit_build"}
    optional = {"evidence_jsonl"}
    if not isinstance(config, dict) or set(config) - required - optional or not required <= set(config):
        raise ProbeRefused("Unexpected or missing configuration fields")
    if config["schema"] != "keo-dynamo-d0-config/v1":
        raise ProbeRefused("Unsupported configuration schema")
    target = canonical_path(config["expected_rvt_path"], ".rvt")
    if not isinstance(config["expected_sha256"], str) or not re.fullmatch(r"[0-9a-fA-F]{64}", config["expected_sha256"]):
        raise ProbeRefused("An independently recorded RVT SHA-256 is required")
    for key in ("expected_revit_version", "expected_revit_build"):
        if not isinstance(config[key], str) or not config[key].strip():
            raise ProbeRefused("An explicit Revit version/build is required")
    if config.get("evidence_jsonl"):
        canonical_path(config["evidence_jsonl"], ".jsonl")
    return target


def run_probe(config, enabled, nonce, host_factory):
    result = {
        "schema": "keo-dynamo-d0-evidence/v1", "probeVersion": PROBE_VERSION,
        "sourceSha256": SOURCE_SHA256, "runId": str(uuid.uuid4()),
        "runNonce": str(nonce), "utc": datetime.datetime.now(datetime.timezone.utc).isoformat(),
        "status": "ERROR", "modelAccepted": False, "geometryAccepted": False,
        "normativeAccepted": False, "modelWriteRequested": False,
    }
    host = None
    before = None
    try:
        target = validate_config(config)
        if type(enabled) is not bool:
            raise ProbeRefused("Enabled must be a Boolean")
        if not enabled:
            result.update(status="CANCELLED", reason="Disabled before accessing Revit")
            return result
        host = host_factory()
        identity = host.identity()
        if canonical_path(identity["path"], ".rvt") != target:
            raise ProbeRefused("Active document does not match the explicitly selected test RVT")
        if identity["revitVersion"] != config["expected_revit_version"] or identity["revitBuild"] != config["expected_revit_build"]:
            raise ProbeRefused("Revit version/build mismatch")
        # Runtime metadata is diagnostic even if the document fails the guard.
        result["environment"] = host.environment()
        before = host.snapshot()
        result["before"] = before
        if any(before[key] for key in ("isModified", "isModifiable", "isWorkshared", "isLinked", "isFamilyDocument", "isModelInCloud")):
            raise ProbeRefused("Only unchanged saved standalone local root RVT is supported by D0")
        if before["sha256"].lower() != config["expected_sha256"].lower():
            raise ProbeRefused("RVT differs from the independently recorded SHA-256")
        result["document"] = identity
        result["roomCount"] = host.room_count()
        result["status"] = "READ_ONLY_OK"
    except ProbeRefused as exc:
        result.update(status="REFUSED", reason=str(exc))
    except Exception as exc:
        result.update(status="ERROR", reason=type(exc).__name__ + ": " + str(exc))
    finally:
        if host is not None and before is not None:
            try:
                after = host.snapshot()
                result["after"] = after
                result["documentUnchanged"] = before == after
                if before != after:
                    result.update(status="ERROR", reason="Document/file changed during probe")
            except Exception as exc:
                result.update(status="ERROR", documentUnchanged=False,
                              reason="Post-check failed: " + type(exc).__name__ + ": " + str(exc))
    return result


class RevitHost:
    def __init__(self):
        import clr
        clr.AddReference("RevitAPI")
        clr.AddReference("RevitServices")
        from RevitServices.Persistence import DocumentManager
        from Autodesk.Revit import DB
        self.DB = DB
        self.manager = DocumentManager.Instance
        self.doc = self.manager.CurrentDBDocument
        self.ui = self.manager.CurrentUIApplication
        if self.doc is None or self.ui is None or self.ui.ActiveUIDocument is None:
            raise ProbeRefused("No active Revit document")
        if not self.doc.Equals(self.ui.ActiveUIDocument.Document):
            raise ProbeRefused("Dynamo and Revit active documents differ")

    def identity(self):
        app = self.ui.Application
        return {"path": str(self.doc.PathName), "title": str(self.doc.Title),
                "revitVersion": str(app.VersionNumber), "revitBuild": str(app.VersionBuild)}

    def snapshot(self):
        from System import BitConverter
        from System.IO import FileStream, FileMode, FileAccess, FileShare
        from System.Security.Cryptography import SHA256
        if not self.doc.IsValidObject or not self.doc.Equals(self.manager.CurrentDBDocument) or not self.doc.Equals(self.ui.ActiveUIDocument.Document):
            raise ProbeRefused("Active document changed")
        path = str(self.doc.PathName)
        canonical_path(path, ".rvt")
        version = self.DB.Document.GetDocumentVersion(self.doc)
        try:
            result = {"path": path, "versionGuid": str(version.VersionGUID),
                      "numberOfSaves": int(version.NumberOfSaves)}
        finally:
            version.Dispose()
        for name in ("IsModified", "IsModifiable", "IsWorkshared", "IsLinked", "IsFamilyDocument", "IsModelInCloud"):
            result[name[0].lower() + name[1:]] = bool(getattr(self.doc, name))
        stream = FileStream(path, FileMode.Open, FileAccess.Read, FileShare.ReadWrite)
        hasher = SHA256.Create()
        try:
            result["fileLength"] = int(stream.Length)
            result["sha256"] = str(BitConverter.ToString(hasher.ComputeHash(stream))).replace("-", "").lower()
        finally:
            hasher.Dispose()
            stream.Dispose()
        return result

    def environment(self):
        import platform
        from System import AppDomain, Environment
        from System.Diagnostics import FileVersionInfo, Process
        names = {"DynamoCore", "DynamoRevitDS", "RevitAPI", "RevitServices", "Python.Runtime", "DSPythonNet3"}
        assemblies = []
        for assembly in AppDomain.CurrentDomain.GetAssemblies():
            name = str(assembly.GetName().Name)
            if name in names:
                info = FileVersionInfo.GetVersionInfo(assembly.Location)
                assemblies.append({"name": name, "assemblyVersion": str(assembly.GetName().Version),
                                   "fileVersion": str(info.FileVersion)})
        return {"python": sys.version, "pythonImplementation": platform.python_implementation(),
                "dotnet": str(Environment.Version), "processId": int(Process.GetCurrentProcess().Id),
                "assemblies": sorted(assemblies, key=lambda item: item["name"])}

    def room_count(self):
        collector = self.DB.FilteredElementCollector(self.doc).OfCategory(self.DB.BuiltInCategory.OST_Rooms).WhereElementIsNotElementType()
        try:
            return int(collector.GetElementCount())
        finally:
            collector.Dispose()


def dynamo_entry(inputs):
    if len(inputs) != 3:
        raise ProbeRefused("Expected configuration path, enabled Boolean and run nonce")
    path = inputs[0]
    canonical_path(path, ".json")
    if os.path.getsize(path) > 65536:
        raise ProbeRefused("Configuration exceeds 64 KiB")
    with open(path, "r", encoding="utf-8-sig") as stream:
        config = json.load(stream)
    result = run_probe(config, inputs[1], inputs[2], RevitHost)
    # Append only to an explicit local evidence log; never open the RVT for writing.
    # Invalid configuration cannot grant permission to write an output file.
    validate_config(config)
    if config.get("evidence_jsonl"):
        output = config["evidence_jsonl"]
        if os.path.exists(output):
            if os.path.getsize(output) > 10 * 1024 * 1024:
                raise ProbeRefused("Evidence log exceeds 10 MiB")
            with open(output, "r", encoding="utf-8") as stream:
                for line in stream:
                    if line.strip() and json.loads(line).get("schema") != result["schema"]:
                        raise ProbeRefused("Existing file is not a D0 evidence log")
        with open(output, "a", encoding="utf-8", newline="\n") as stream:
            stream.write(json.dumps(result, ensure_ascii=False, sort_keys=True) + "\n")
    return json.dumps(result, ensure_ascii=False, indent=2, sort_keys=True)


"""D1 diagnostic Room capture. Root standalone only; never writes a Revit document.

The generator embeds the tested D0 host/guards. Offline imports use the same file.
This is a stage-specific diagnostic schema, not the older SDK codec or KEO input.
"""
import hashlib
import math
if "RevitHost" not in globals():
    from d0_probe import (RevitHost, ProbeRefused, canonical_path, validate_config,
                          datetime, json, os, uuid)

D1_VERSION = "0.1.0"
D1_SCHEMA = "keo-dynamo-d1-evidence/v1"
BUNDLE_SHA256 = globals().get("BUNDLE_SHA256", "unbundled")
BASE_FIELDS = {"expected_rvt_path", "expected_sha256", "expected_revit_version", "expected_revit_build"}


def base_config(config):
    return dict({key: config[key] for key in BASE_FIELDS}, schema="keo-dynamo-d0-config/v1")


def validate_d1(config):
    required = BASE_FIELDS | {"schema", "mode", "evidence_jsonl"}
    optional = {"sample_element_id", "phase_uid", "parameter", "value", "selected_room_uid"}
    if not isinstance(config, dict) or not required <= set(config) or set(config) - required - optional:
        raise ProbeRefused("Missing or unknown D1 configuration fields")
    if config["schema"] != "keo-dynamo-d1-config/v1" or config["mode"] not in ("inventory", "capture"):
        raise ProbeRefused("Unsupported D1 schema/mode")
    target = validate_config(base_config(config))
    canonical_path(config["evidence_jsonl"], ".jsonl")
    if config["mode"] == "inventory":
        if not str(config.get("sample_element_id", "")).isdigit():
            raise ProbeRefused("Inventory requires an explicit sample element id")
    else:
        for key in ("phase_uid", "selected_room_uid"):
            if not isinstance(config.get(key), str) or not config[key]:
                raise ProbeRefused("Explicit phase and selected Room UniqueId required")
        selector = config.get("parameter")
        if not isinstance(selector, dict) or set(selector) != {"kind", "key"}:
            raise ProbeRefused("Parameter selector requires kind and key")
        if selector["kind"] == "id":
            if not isinstance(selector["key"], str) or not selector["key"].lstrip("-").isdigit():
                raise ProbeRefused("Parameter id must be a decimal string")
        elif selector["kind"] == "guid":
            try:
                uuid.UUID(selector["key"])
            except (ValueError, TypeError, AttributeError):
                raise ProbeRefused("Invalid shared parameter GUID")
        else:
            raise ProbeRefused("Select parameter by id/GUID, never by localized name")
        if "value" not in config or type(config["value"]) not in (str, int, float):
            raise ProbeRefused("Explicit typed parameter value required")
        if isinstance(config["value"], float) and not math.isfinite(config["value"]):
            raise ProbeRefused("Non-finite filter value")
    return target


def matches_parameter(parameter, expected):
    if parameter is None or not parameter.get("hasValue"):
        return False
    storage = parameter["storageType"]
    value = parameter["value"]
    if storage == "String":
        return type(expected) is str and value == expected
    if storage == "Integer":
        return type(expected) is int and value == expected
    if storage == "Double":
        return type(expected) in (float, int) and math.isfinite(expected) and value == expected
    if storage == "ElementId":
        return type(expected) is str and value == expected
    raise ProbeRefused("Unsupported filter storage type")


def select_room(rows, phase_uid, expected, selected_uid):
    scoped = [row for row in rows if row["phase"]["uniqueId"] == phase_uid]
    matched = [row for row in scoped if matches_parameter(row["filterParameter"], expected)]
    selected = [row for row in matched if row["ref"]["uniqueId"] == selected_uid]
    if len(selected) != 1:
        raise ProbeRefused("Selected Room must occur exactly once in the phase/parameter result")
    counts = {"phaseRooms": len(scoped), "matchedRooms": len(matched),
              "missingParameter": sum(row["filterParameter"] is None for row in scoped),
              "emptyParameter": sum(row["filterParameter"] is not None and
                                    (not row["filterParameter"]["hasValue"] or row["filterParameter"]["value"] in (None, "")) for row in scoped)}
    return selected[0], counts


def rr(source, function):
    try:
        return {"status": "ok", "source": source, "value": function()}
    except Exception as exc:
        return {"status": "error", "source": source, "reason": type(exc).__name__ + ": " + str(exc)}


def unavailable(source, reason, status="unavailable"):
    return {"status": status, "source": source, "reason": reason}


class D1Host(RevitHost):
    @staticmethod
    def eid(value):
        return str(value.Value)

    @staticmethod
    def xyz(value):
        return [float(value.X), float(value.Y), float(value.Z)]

    def ref(self, element):
        if element is None:
            raise ProbeRefused("Unresolved element reference")
        return {"documentKey": str(element.Document.ProjectInformation.UniqueId),
                "uniqueId": str(element.UniqueId), "elementId": self.eid(element.Id)}

    def resolve(self, eid, doc=None):
        el = (doc or self.doc).GetElement(eid)
        return self.ref(el) if el is not None else None

    def param(self, parameter):
        if parameter is None:
            return None
        storage = str(parameter.StorageType)
        value = None
        if parameter.HasValue:
            if storage == "String": value = parameter.AsString()
            elif storage == "Integer": value = int(parameter.AsInteger())
            elif storage == "Double": value = float(parameter.AsDouble())
            elif storage == "ElementId": value = self.eid(parameter.AsElementId())
            else: raise ProbeRefused("Unsupported parameter storage: " + storage)
        return {"id": self.eid(parameter.Id), "name": str(parameter.Definition.Name),
                "guid": str(parameter.GUID) if parameter.IsShared else None,
                "specTypeId": str(parameter.Definition.GetDataType().TypeId),
                "storageType": storage, "hasValue": bool(parameter.HasValue), "value": value}

    def builtin(self, element, name):
        return self.param(element.get_Parameter(getattr(self.DB.BuiltInParameter, name)))

    def phase(self, room):
        p = room.get_Parameter(self.DB.BuiltInParameter.ROOM_PHASE_ID)
        if p is None or str(p.StorageType) != "ElementId":
            raise ProbeRefused("ROOM_PHASE_ID is absent or not ElementId")
        phase = self.doc.GetElement(p.AsElementId())
        if phase is None or not isinstance(phase, self.DB.Phase):
            raise ProbeRefused("Unresolved Room phase")
        return self.ref(phase)

    def option(self, element):
        option = element.DesignOption
        return {"kind": "main-model"} if option is None else {"kind": "design-option", "ref": self.ref(option)}

    def lifecycle(self, element):
        if not element.HasPhases():
            return {"hasPhases": False, "created": None, "demolished": None,
                    "source": "Element.HasPhases; lifecycle not applicable"}
        return {"hasPhases": True, "created": self.resolve(element.CreatedPhaseId, element.Document),
                "demolished": self.resolve(element.DemolishedPhaseId, element.Document),
                "source": "Element.CreatedPhaseId/DemolishedPhaseId"}

    def filter_parameter(self, room, selector):
        if selector["kind"] == "guid":
            from System import Guid
            return self.param(room.get_Parameter(Guid(selector["key"])))
        candidates = [p for p in room.Parameters if self.eid(p.Id) == selector["key"]]
        if len(candidates) > 1:
            raise ProbeRefused("Non-unique parameter id")
        return self.param(candidates[0]) if candidates else None

    def room_rows(self, selector=None):
        collector = self.DB.FilteredElementCollector(self.doc).OfCategory(self.DB.BuiltInCategory.OST_Rooms).WhereElementIsNotElementType()
        try:
            rows = []
            for room in collector:
                rows.append({"ref": self.ref(room), "phase": self.phase(room), "number": str(room.Number),
                             "name": self.builtin(room, "ROOM_NAME")["value"],
                             "filterParameter": self.filter_parameter(room, selector) if selector else None})
            return rows
        finally:
            collector.Dispose()

    def inventory(self, config):
        from System import Int64
        sample = self.doc.GetElement(self.DB.ElementId(Int64.Parse(config["sample_element_id"])))
        if sample is None or self.eid(sample.Category.Id) != str(int(self.DB.BuiltInCategory.OST_Rooms)):
            raise ProbeRefused("Sample element is not a root Room")
        return {"phases": [{"ref": self.ref(p), "name": str(p.Name)} for p in self.doc.Phases],
                "rooms": self.room_rows(), "sample": self.ref(sample),
                "sampleParameters": sorted([self.param(p) for p in sample.Parameters], key=lambda p: int(p["id"]))}

    def matrix(self, transform):
        x, y, z, o = (self.xyz(v) for v in (transform.BasisX, transform.BasisY, transform.BasisZ, transform.Origin))
        return [x[0], y[0], z[0], o[0], x[1], y[1], z[1], o[1], x[2], y[2], z[2], o[2], 0, 0, 0, 1]

    def link_inventory(self):
        collector = self.DB.FilteredElementCollector(self.doc).OfClass(self.DB.RevitLinkInstance)
        result = []
        try:
            for link in collector:
                link_type = self.doc.GetElement(link.GetTypeId())
                linked = link.GetLinkDocument()
                record = {"ref": self.ref(link), "instancePath": [self.ref(link)], "type": self.ref(link_type),
                          "loaded": linked is not None, "option": self.option(link),
                          "transform": rr("RevitLinkInstance.GetTransform; linked-internal-ft to root-internal-ft",
                                          lambda: self.matrix(link.GetTransform())),
                          "roomBoundingInstance": rr("WALL_ATTR_ROOM_BOUNDING on instance", lambda: self.builtin(link, "WALL_ATTR_ROOM_BOUNDING")),
                          "roomBoundingType": rr("WALL_ATTR_ROOM_BOUNDING on type", lambda: self.builtin(link_type, "WALL_ATTR_ROOM_BOUNDING")),
                          "nestedGeometry": unavailable("D1 scope", "Nested link geometry not traversed", "unsupported")}
                if linked is None:
                    record["phaseMap"] = unavailable("RevitLinkType.GetPhaseMap", "Link is unloaded")
                else:
                    record["linkedDocument"] = {"documentKey": str(linked.ProjectInformation.UniqueId), "isModified": bool(linked.IsModified)}
                    record["phaseMap"] = rr("RevitLinkType.GetPhaseMap; host phase -> linked phase",
                        lambda: [{"host": self.resolve(pair.Key), "linked": self.resolve(pair.Value, linked)} for pair in link_type.GetPhaseMap()])
                result.append(record)
            return result
        finally:
            collector.Dispose()

    def generator(self, segment):
        el = self.doc.GetElement(segment.ElementId)
        record = {"elementId": self.eid(segment.ElementId), "linkElementId": self.eid(segment.LinkElementId)}
        if el is None:
            return dict(record, status="unresolved", reason="Free or unavailable boundary generator")
        record.update(status="ok", ref=self.ref(el), categoryId=self.eid(el.Category.Id) if el.Category else None,
                      option=self.option(el), lifecycle=self.lifecycle(el))
        if isinstance(el, self.DB.RevitLinkInstance):
            linked = el.GetLinkDocument()
            record.update(status="unsupported", reason="Linked boundary requires separate linked geometry validation",
                          linkedRef=self.resolve(segment.LinkElementId, linked) if linked is not None else None)
        elif el.Category and el.Category.Id == self.DB.ElementId(self.DB.BuiltInCategory.OST_RoomSeparationLines):
            record["classification"] = "semantic-room-separator-not-physical-wall"
        else:
            record["classification"] = "wall" if isinstance(el, self.DB.Wall) else "other"
            record["roomBounding"] = rr("WALL_ATTR_ROOM_BOUNDING", lambda: self.builtin(el, "WALL_ATTR_ROOM_BOUNDING"))
        return record

    def external_references(self):
        # Include CAD/other references and uninstanced types; an empty RVT-instance
        # collector is not evidence that all external geometry is available.
        records = []
        for eid in self.DB.ExternalFileUtils.GetAllExternalFileReferences(self.doc):
            reference = self.DB.ExternalFileUtils.GetExternalFileReference(self.doc, eid)
            try:
                records.append({"ref": self.resolve(eid), "elementId": self.eid(eid),
                                "referenceType": str(reference.ExternalFileReferenceType),
                                "linkedFileStatus": str(reference.GetLinkedFileStatus()),
                                "geometryRelevance": "not assessed"})
            finally:
                reference.Dispose()
        return records

    def curve(self, curve):
        record = {"nativeType": str(curve.GetType().FullName), "isBound": bool(curve.IsBound)}
        if not curve.IsBound:
            return dict(record, status="unsupported", reason="Unbounded curve")
        record.update(parameterRange=[float(curve.GetEndParameter(i)) for i in (0, 1)],
                      start=self.xyz(curve.GetEndPoint(0)), end=self.xyz(curve.GetEndPoint(1)), lengthFt=float(curve.Length))
        if isinstance(curve, self.DB.Line):
            record.update(status="ok", kind="Line")
        elif isinstance(curve, self.DB.Arc):
            record.update(status="ok", kind="Arc", center=self.xyz(curve.Center), radiusFt=float(curve.Radius),
                          normal=self.xyz(curve.Normal), xDirection=self.xyz(curve.XDirection), yDirection=self.xyz(curve.YDirection))
        else:
            record.update(status="unsupported", reason="Native curve preserved by type; D1 has no complete serializer")
        return record

    def boundaries(self, room):
        options = self.DB.SpatialElementBoundaryOptions()
        options.SpatialElementBoundaryLocation = self.DB.SpatialElementBoundaryLocation.Finish
        options.StoreFreeBoundaryFaces = True
        try:
            loops = room.GetBoundarySegments(options)
            if loops is None:
                return {"status": "unavailable", "reason": "No boundary loops; not enclosed or unplaced"}
            result = []
            for loop in loops:
                output = []
                for segment in loop:
                    curve = segment.GetCurve()
                    try:
                        output.append({"curve": self.curve(curve), "generator": self.generator(segment)})
                    finally:
                        curve.Dispose()
                        segment.Dispose()
                result.append(output)
            return {"status": "ok", "source": "Room.GetBoundarySegments", "location": "Finish",
                    "storeFreeBoundaryFaces": True, "loopsInApiOrder": result,
                    "sectionAt1_2m": False, "outerHoleClassification": "not inferred from API order"}
        finally:
            options.Dispose()

    def north(self):
        location = self.doc.ActiveProjectLocation
        position = location.GetProjectPosition(self.DB.XYZ.Zero)
        try:
            return {"projectLocation": self.ref(location), "source": "ProjectLocation.GetProjectPosition(XYZ.Zero)",
                    "angleFromTrueNorthRadians": float(position.Angle), "eastWestFt": float(position.EastWest),
                    "northSouthFt": float(position.NorthSouth), "elevationFt": float(position.Elevation),
                    "appliedToInternalGeometry": False}
        finally:
            position.Dispose()

    def capture(self, config):
        rows = self.room_rows(config["parameter"])
        row, counts = select_room(rows, config["phase_uid"], config["value"], config["selected_room_uid"])
        room = self.doc.GetElement(row["ref"]["uniqueId"])
        if room is None:
            raise ProbeRefused("Room disappeared")
        if self.option(room)["kind"] != "main-model":
            raise ProbeRefused("D1 captures Main Model only; design option is unsupported")
        level = self.doc.GetElement(room.LevelId)
        location = room.Location
        location_record = unavailable("Room.Location", "Room has no LocationPoint")
        if isinstance(location, self.DB.LocationPoint):
            point = location.Point
            location_record = {"status": "ok", "source": "Room.Location/LocationPoint.Point", "xyzFt": self.xyz(point),
                               "isPointInRoom": bool(room.IsPointInRoom(point)), "isDaylightCalculationPoint": False}
        boundaries = self.boundaries(room)
        links = self.link_inventory()
        external = rr("ExternalFileUtils.GetAllExternalFileReferences/GetExternalFileReference", self.external_references)
        diagnostics = []
        if external["status"] != "ok": diagnostics.append("EXTERNAL_REFERENCE_INVENTORY_FAILED")
        elif any(item["linkedFileStatus"] != "Loaded" for item in external["value"]):
            diagnostics.append("EXTERNAL_REFERENCES_NOT_LOADED: geometry relevance unresolved")
        if any(not link["loaded"] for link in links): diagnostics.append("UNLOADED_LINKS: relevance to geometry/shading is unresolved")
        if any(link["phaseMap"]["status"] != "ok" for link in links): diagnostics.append("LINK_PHASE_MAP_INCOMPLETE")
        if boundaries["status"] != "ok": diagnostics.append("ROOM_BOUNDARIES_UNAVAILABLE")
        else:
            for loop in boundaries["loopsInApiOrder"]:
                for segment in loop:
                    if segment["curve"]["status"] != "ok": diagnostics.append("UNSUPPORTED_NATIVE_CURVE")
                    if segment["generator"]["status"] != "ok": diagnostics.append("BOUNDARY_GENERATOR_UNRESOLVED_OR_LINKED")
        if location_record["status"] != "ok" or room.Area <= 0: diagnostics.append("ROOM_UNPLACED_OR_NONPOSITIVE_AREA")
        north = rr("ProjectLocation.GetProjectPosition", self.north)
        if north["status"] != "ok": diagnostics.append("NORTH_UNAVAILABLE")
        return {"units": {"frame": "revit-internal-feet", "length": "ft", "area": "ft2", "volume": "ft3", "metresPerFoot": 0.3048,
                          "matrixConvention": "row-major-4x4-column-vector", "rootTransform": [1,0,0,0,0,1,0,0,0,0,1,0,0,0,0,1]},
                "scope": {"kind": "one-root-room", "selected": row["ref"], "phase": row["phase"], "filter": config["parameter"],
                          "value": config["value"], "counts": counts, "linksInventoriedRegardlessOfRoomFilter": True},
                "room": {**row, "versionGuid": str(room.VersionGuid), "option": self.option(room), "lifecycle": self.lifecycle(room),
                         "location": location_record, "level": self.ref(level),
                         "levelProjectElevationFt": float(level.ProjectElevation),
                         "levelComputationHeight": self.builtin(level, "LEVEL_ROOM_COMPUTATION_HEIGHT"),
                         "constraints": {key: self.builtin(room, key) for key in ("ROOM_UPPER_LEVEL", "ROOM_UPPER_OFFSET", "ROOM_LOWER_OFFSET")},
                         "areaFt2": float(room.Area), "perimeterFt": float(room.Perimeter), "volumeFt3": float(room.Volume),
                         "volumeMeaning": "Room.Volume may be zero when volume computation is disabled; not a verified 3D volume"},
                "boundaries": boundaries, "north": north, "links": links, "externalReferences": external,
                "diagnostics": sorted(set(diagnostics)), "geometryAccepted": False, "normativeAccepted": False,
                "aperturesAndShading": "not captured by D1"}


def run_d1(config, enabled, nonce, host_factory=D1Host):
    result = {"schema": D1_SCHEMA, "version": D1_VERSION, "sourceBundleSha256": BUNDLE_SHA256,
              "runId": str(uuid.uuid4()), "runNonce": str(nonce), "utc": datetime.datetime.now(datetime.timezone.utc).isoformat(),
              "status": "ERROR", "modelAccepted": False, "geometryAccepted": False, "normativeAccepted": False, "modelWriteRequested": False}
    host, before = None, None
    try:
        target = validate_d1(config)
        if type(enabled) is not bool: raise ProbeRefused("Enabled must be a Boolean")
        if not enabled:
            result.update(status="CANCELLED", reason="Disabled before accessing Revit")
            return result
        host = host_factory()
        identity = host.identity()
        if canonical_path(identity["path"], ".rvt") != target: raise ProbeRefused("Active document is not the explicitly selected test copy")
        if identity["revitVersion"] != config["expected_revit_version"] or identity["revitBuild"] != config["expected_revit_build"]:
            raise ProbeRefused("Unexpected Revit version/build")
        before = host.snapshot()
        result["before"] = before
        if any(before[key] for key in ("isModified", "isModifiable", "isWorkshared", "isLinked", "isFamilyDocument", "isModelInCloud")):
            raise ProbeRefused("D1 requires clean saved standalone root document")
        if before["sha256"].lower() != config["expected_sha256"].lower(): raise ProbeRefused("Test RVT hash differs from approved baseline")
        result["environment"] = host.environment()
        payload = host.inventory(config) if config["mode"] == "inventory" else host.capture(config)
        result.update(status="INVENTORY_OK" if config["mode"] == "inventory" else "CAPTURED_DIAGNOSTIC", payload=payload)
        result["payloadSha256"] = hashlib.sha256(json.dumps(payload, sort_keys=True, ensure_ascii=False, allow_nan=False, separators=(",", ":")).encode("utf-8")).hexdigest()
    except ProbeRefused as exc:
        result.update(status="REFUSED", reason=str(exc))
    except Exception as exc:
        result.update(status="ERROR", reason=type(exc).__name__ + ": " + str(exc))
    finally:
        if host is not None and before is not None:
            try:
                result["after"] = host.snapshot()
                result["documentUnchanged"] = before == result["after"]
                if not result["documentUnchanged"]: result.update(status="ERROR", reason="Document/file changed during D1")
            except Exception as exc:
                result.update(status="ERROR", documentUnchanged=False, reason="Post-check failed: " + str(exc))
    return result


def d1_entry(inputs):
    if len(inputs) != 3: raise ProbeRefused("Expected config path, enabled and run number")
    path = inputs[0]
    canonical_path(path, ".json")
    if os.path.getsize(path) > 65536: raise ProbeRefused("Configuration exceeds 64 KiB")
    with open(path, "r", encoding="utf-8-sig") as stream: config = json.load(stream)
    validate_d1(config)
    result = run_d1(config, inputs[1], inputs[2])
    output = config["evidence_jsonl"]
    if os.path.exists(output):
        if os.path.getsize(output) > 25 * 1024 * 1024: raise ProbeRefused("D1 evidence log exceeds 25 MiB")
        with open(output, "r", encoding="utf-8") as stream:
            for line in stream:
                if line.strip() and json.loads(line).get("schema") != D1_SCHEMA: raise ProbeRefused("Existing output is not a D1 evidence log")
    serialized = json.dumps(result, ensure_ascii=False, sort_keys=True, allow_nan=False)
    with open(output, "a", encoding="utf-8", newline="\n") as stream: stream.write(serialized + "\n")
    return json.dumps({key: value for key, value in result.items() if key != "payload"}, ensure_ascii=False, indent=2)


"""Physical face evidence only. Display transparency is NOT optical transmittance."""


def walk_symbol_geometry(geometry, transform, db, solid_callback, other_callback, path=(), depth=0):
    if depth > 12:
        raise ValueError("Nested geometry exceeds depth limit")
    for index, obj in enumerate(geometry):
        key = path + (index,)
        if isinstance(obj, db.GeometryInstance):
            child = obj.GetSymbolGeometry()
            combined = transform.Multiply(obj.Transform)
            try:
                walk_symbol_geometry(child, combined, db, solid_callback, other_callback, key, depth + 1)
            finally:
                if child is not None: child.Dispose()
                combined.Dispose()
        elif isinstance(obj, db.Solid):
            solid_callback(obj, transform, key)
        else:
            other_callback(obj, key)


def box_contains(outer, inner, tolerance=1e-4):
    return all(outer[0][i] - tolerance <= inner[0][i] and
               inner[1][i] <= outer[1][i] + tolerance for i in range(3))


class PhysicalGeometryMixin:
    def material_record(self, material_id):
        material = self.doc.GetElement(material_id)
        if material is None:
            return {"id": self.eid(material_id), "status": "unresolved", "opticalTransmittance": None}
        return {"ref": self.ref(material), "name": str(material.Name),
                "displayTransparencyPercent": int(material.Transparency),
                "appearanceAsset": self.resolve(material.AppearanceAssetId),
                "opticalTransmittance": None, "opticalSource": "not established"}

    def face_room_probe(self, face, room):
        if not isinstance(face, self.DB.PlanarFace):
            return {"status": "unsupported", "reason": "Nonplanar face"}
        bounds = face.GetBoundingBox()
        uv = self.DB.UV((bounds.Min.U + bounds.Max.U) / 2, (bounds.Min.V + bounds.Max.V) / 2)
        if not face.IsInside(uv):
            return {"status": "unavailable", "reason": "UV midpoint outside trimmed face"}
        point, normal = face.Evaluate(uv), face.ComputeNormal(uv)
        samples = []
        for mm in (10, 100, 500):
            delta = normal.Multiply(mm / 304.8)
            samples.append({"offsetMm": mm, "plusInSelectedRoom": bool(room.IsPointInRoom(point.Add(delta))),
                            "minusInSelectedRoom": bool(room.IsPointInRoom(point.Subtract(delta)))})
        return {"status": "ok", "pointFt": self.xyz(point), "normal": self.xyz(normal),
                "samples": samples, "visibilityAccepted": False,
                "meaning": "Local point membership only; not a ray or exterior classification"}

    def physical_geometry(self, element, room):
        options = self.DB.Options()
        options.DetailLevel = self.DB.ViewDetailLevel.Fine
        options.IncludeNonVisibleObjects = False
        options.ComputeReferences = False
        geometry = None
        solids, other, materials = [], [], {}
        face_count = 0
        def record_solid(solid, transform, key):
            nonlocal face_count
            if solid.Faces.Size == 0:
                return
            face_count += solid.Faces.Size
            if face_count > 5000:
                raise ValueError("Physical element face limit reached; no truncated acceptance")
            world = self.DB.SolidUtils.CreateTransformed(solid, transform)
            try:
                faces = []
                for face in world.Faces:
                    record = self.face_record(face)
                    material_key = self.eid(face.MaterialElementId)
                    if material_key not in materials:
                        materials[material_key] = self.material_record(face.MaterialElementId)
                    if materials[material_key].get("displayTransparencyPercent", 0) > 0:
                        record["roomProbe"] = self.face_room_probe(face, room)
                    faces.append(record)
                bounds = world.GetBoundingBox()
                try:
                    pts = [self.xyz(bounds.Transform.OfPoint(self.DB.XYZ(x, y, z)))
                           for x in (bounds.Min.X, bounds.Max.X) for y in (bounds.Min.Y, bounds.Max.Y)
                           for z in (bounds.Min.Z, bounds.Max.Z)]
                    bbox = [[min(p[i] for p in pts) for i in range(3)], [max(p[i] for p in pts) for i in range(3)]]
                finally:
                    bounds.Dispose()
                element_box = self.box(element)
                solids.append({"geometryPath": list(key), "symbolToRootTransform": self.matrix(transform),
                               "volumeFt3": float(world.Volume), "surfaceAreaFt2": float(world.SurfaceArea),
                               "bboxFt": bbox, "insideElementBbox": box_contains(element_box, bbox) if element_box else None,
                               "faces": faces})
            finally:
                world.Dispose()
        def record_other(obj, key):
            other.append({"geometryPath": list(key), "nativeType": str(obj.GetType().FullName),
                          "status": "not serialized", "couldAffectCompleteness": True})
        identity = self.DB.Transform.Identity
        try:
            geometry = element.get_Geometry(options)
            if geometry is None:
                raise ValueError("Element has no physical geometry")
            walk_symbol_geometry(geometry, identity, self.DB, record_solid, record_other)
            return {"source": self.ref(element), "coordinates": "root Revit internal feet",
                    "detailLevel": "Fine", "includeNonVisibleObjects": False,
                    "extraction": "GetSymbolGeometry + accumulated Transform + SolidUtils.CreateTransformed",
                    "solids": solids, "otherGeometry": other, "materials": materials,
                    "glazingAccepted": False, "visibilityAccepted": False,
                    "limits": ["Display transparency is not optical transmittance",
                               "Opposite glass faces/layers are not distinct apertures",
                               "Membership probes do not establish visibility or exterior",
                               "Shared children may be separate elements; no deduplication or full shading"]}
        finally:
            identity.Dispose()
            if geometry is not None: geometry.Dispose()
            options.Dispose()

"""D2 reconnaissance only: native room solid and candidate metadata, no KEO.

Bounding boxes are broad-phase candidates, never glazing or shading evidence.
Reuses D1 clean-document guards. No transaction, save or model mutation.
"""
if "D1Host" not in globals():
    from d1_capture import D1Host, rr, ProbeRefused, run_d1, validate_d1
    from d0_probe import canonical_path, json, os

D2_SCHEMA = "keo-dynamo-d2-inspection/v1"
if "PhysicalGeometryMixin" not in globals():
    from d2_geometry import PhysicalGeometryMixin


def overlaps_xy(a, b, padding=0.0):
    return all(a[0][i] <= b[1][i] + padding and a[1][i] >= b[0][i] - padding for i in (0, 1))


def phase_room(element, phase, side):
    # PythonNet3 resolves FromRoom/ToRoom as the parameterless property.
    # Call the phase overload explicitly; a Room itself is not a phase indexer.
    if side not in ("FromRoom", "ToRoom"):
        raise ValueError("Expected FromRoom or ToRoom")
    return getattr(element, "get_" + side)(phase)


def adapt_config(config):
    if not isinstance(config, dict) or config.get("schema") != "keo-dynamo-d2-config/v1":
        raise ProbeRefused("D2 configuration required")
    result = dict(config, schema="keo-dynamo-d1-config/v1")
    validate_d1(result)
    if result["mode"] != "capture":
        raise ProbeRefused("D2 requires explicit capture selection")
    return result


class D2Host(PhysicalGeometryMixin, D1Host):
    def phase_room_ref(self, element, phase, side):
        room = phase_room(element, phase, side)
        return self.ref(room) if room is not None else None

    def box(self, element):
        box = element.get_BoundingBox(None)
        if box is None:
            return None
        try:
            points = [self.xyz(box.Transform.OfPoint(self.DB.XYZ(x, y, z)))
                      for x in (box.Min.X, box.Max.X) for y in (box.Min.Y, box.Max.Y) for z in (box.Min.Z, box.Max.Z)]
            return [[min(p[i] for p in points) for i in range(3)], [max(p[i] for p in points) for i in range(3)]]
        finally:
            box.Dispose()

    def face_record(self, face):
        loops = []
        for loop in face.GetEdgesAsCurveLoops():
            try:
                loops.append([self.curve(curve) for curve in loop])
            finally:
                loop.Dispose()
        data = {"nativeType": str(face.GetType().FullName), "areaFt2": float(face.Area),
                "materialId": self.eid(face.MaterialElementId), "loops": loops}
        if isinstance(face, self.DB.PlanarFace):
            data.update(originFt=self.xyz(face.Origin), normal=self.xyz(face.FaceNormal))
        else:
            data["surfaceAccepted"] = False
        return data

    def room_solid(self, room):
        options = self.DB.SpatialElementBoundaryOptions()
        options.SpatialElementBoundaryLocation = self.DB.SpatialElementBoundaryLocation.Finish
        options.StoreFreeBoundaryFaces = True
        calculator = self.DB.SpatialElementGeometryCalculator(self.doc, options)
        try:
            result = calculator.CalculateSpatialElementGeometry(room)
            try:
                solid = result.GetGeometry()
                faces = []
                for face in solid.Faces:
                    record = self.face_record(face)
                    subfaces = []
                    for subface in result.GetBoundaryFaceInfo(face) or []:
                        try:
                            boundary = subface.SpatialBoundaryElement
                            subfaces.append({"type": str(subface.SubfaceType),
                                "hostElementId": self.eid(boundary.HostElementId),
                                "linkedElementId": self.eid(boundary.LinkedElementId),
                                "linkInstanceId": self.eid(boundary.LinkInstanceId)})
                        finally:
                            subface.Dispose()
                    record["sources"] = subfaces
                    faces.append(record)
                return {"faces": faces, "volumeFt3": float(solid.Volume),
                        "source": "SpatialElementGeometryCalculator", "physicalOpeningsAccepted": False}
            finally:
                result.Dispose()
        finally:
            calculator.Dispose()
            options.Dispose()

    def metadata(self, element, phase):
        data = {"ref": self.ref(element), "class": str(element.GetType().FullName),
                "categoryId": self.eid(element.Category.Id) if element.Category else None,
                "type": self.resolve(element.GetTypeId()), "bboxFt": self.box(element),
                "option": self.option(element), "lifecycle": self.lifecycle(element),
                "phaseStatus": rr("Element.GetPhaseStatus", lambda: str(element.GetPhaseStatus(phase.Id)))}
        if isinstance(element, self.DB.FamilyInstance):
            data.update(host=self.ref(element.Host) if element.Host else None,
                        supercomponent=self.ref(element.SuperComponent) if element.SuperComponent else None,
                        children=[self.resolve(eid) for eid in element.GetSubComponentIds()],
                        fromRoom=rr("get_FromRoom(phase)", lambda: self.phase_room_ref(element, phase, "FromRoom")),
                        toRoom=rr("get_ToRoom(phase)", lambda: self.phase_room_ref(element, phase, "ToRoom")))
        if isinstance(element, self.DB.HostObject):
            data["inserts"] = rr("FindInserts(True,False,True,True)",
                lambda: [self.resolve(eid) for eid in element.FindInserts(True, False, True, True)])
        if isinstance(element, self.DB.Wall):
            grid = element.CurtainGrid
            data["wallKind"] = str(element.WallType.Kind)
            if grid is not None:
                data["panels"] = [self.resolve(eid) for eid in grid.GetPanelIds()]
                data["mullions"] = [self.resolve(eid) for eid in grid.GetMullionIds()]
        if isinstance(element, self.DB.ImportInstance):
            data.update(isLinked=bool(element.IsLinked), viewSpecific=bool(element.ViewSpecific),
                        ownerView=self.resolve(element.OwnerViewId), transform=self.matrix(element.GetTransform()))
        return data

    def capture(self, config):
        baseline = super().capture(config)
        room = self.doc.GetElement(config["selected_room_uid"])
        phase = self.doc.GetElement(config["phase_uid"])
        room_box = self.box(room)
        if room_box is None:
            raise ProbeRefused("Room has no bounding box")
        categories = ("OST_Walls", "OST_Windows", "OST_Doors", "OST_CurtainWallPanels", "OST_CurtainWallMullions",
                      "OST_Floors", "OST_Roofs", "OST_Ceilings", "OST_Columns", "OST_StructuralColumns", "OST_GenericModel")
        records, counts, missing_boxes, physical = [], {}, [], []
        for category in categories:
            collector = self.DB.FilteredElementCollector(self.doc).OfCategory(getattr(self.DB.BuiltInCategory, category)).WhereElementIsNotElementType()
            try:
                total, included = 0, 0
                for element in collector:
                    total += 1
                    box = self.box(element)
                    if box is None:
                        missing_boxes.append(self.ref(element))
                    elif overlaps_xy(box, room_box, 4.0):
                        if len(records) >= 2000:
                            raise ProbeRefused("Candidate cap reached; no truncated acceptance")
                        records.append(rr("Element metadata", lambda: self.metadata(element, phase)))
                        if category in ("OST_Windows", "OST_Doors", "OST_CurtainWallPanels"):
                            physical.append({"ref": self.ref(element), "category": category,
                                "geometry": rr("Physical geometry", lambda: self.physical_geometry(element, room))})
                        included += 1
                counts[category] = {"wholeRootModel": total, "nearRoomAllHeights": included}
            finally:
                collector.Dispose()
        imports = self.DB.FilteredElementCollector(self.doc).OfClass(self.DB.ImportInstance)
        try:
            import_records = [rr("ImportInstance metadata", lambda: self.metadata(el, phase)) for el in imports]
        finally:
            imports.Dispose()
        return {"d1": baseline, "roomSolid": rr("Native 3D room boundary", lambda: self.room_solid(room)),
                "candidateSelection": {"source": "whole root document category collectors", "roomBboxFt": room_box,
                    "paddingFt": 4.0, "heightFilter": None, "phaseFilter": None, "designOptionFilter": None,
                    "counts": counts, "missingBoundingBoxes": missing_boxes,
                    "purpose": "reconnaissance only; excludes distant shading, linked and unlisted categories"},
                "candidates": records, "imports": import_records, "physicalGeometry": physical,
                "geometryAccepted": False, "normativeAccepted": False, "d2Complete": False,
                "limits": ["No glazing faces or transmittance accepted", "No visibility rays or complete shading",
                           "Room solid may bridge openings; never substitute it for physical occluders"]}


def run_d2(config, enabled, nonce, host_factory=D2Host):
    result = run_d1(adapt_config(config), enabled, nonce, host_factory=host_factory)
    result.update(schema=D2_SCHEMA, version="0.1.0", d2Complete=False)
    return result


def d2_entry(inputs):
    if len(inputs) != 3:
        raise ProbeRefused("Expected config path, enabled, run number")
    path = inputs[0]
    canonical_path(path, ".json")
    if os.path.getsize(path) > 65536:
        raise ProbeRefused("Configuration exceeds 64 KiB")
    with open(path, "r", encoding="utf-8-sig") as stream:
        config = json.load(stream)
    result = run_d2(config, inputs[1], inputs[2])
    target = config["evidence_jsonl"]
    if os.path.exists(target):
        if os.path.getsize(target) > 25 * 1024 * 1024:
            raise ProbeRefused("Evidence log exceeds 25 MiB")
        with open(target, "r", encoding="utf-8") as stream:
            for line in stream:
                if line.strip() and json.loads(line).get("schema") != D2_SCHEMA:
                    raise ProbeRefused("Existing output is not a D2 inspection log")
    serialized = json.dumps(result, ensure_ascii=False, sort_keys=True, allow_nan=False)
    if len(serialized.encode("utf-8")) > 20 * 1024 * 1024:
        raise ProbeRefused("Inspection exceeds 20 MiB")
    with open(target, "a", encoding="utf-8", newline="\n") as stream:
        stream.write(serialized + "\n")
    return json.dumps({k: v for k, v in result.items() if k != "payload"}, ensure_ascii=False, indent=2)


"""Read-only inventory of candidate calculator inputs and plan annotation resources.

Uses D0/D1 guards. Parameter values remain candidates until their meanings,
applicability and provenance are checked; no coefficient defaults or model writes.
"""

class InputHost(D1Host):
    def params(self, element):
        return sorted([self.param(p) for p in element.Parameters], key=lambda p: p["id"])

    def descriptor(self, element):
        if element is None:
            return None
        try:
            name = str(element.Name)
        except (AttributeError, TypeError):
            p = element.get_Parameter(self.DB.BuiltInParameter.SYMBOL_NAME_PARAM)
            name = p.AsString() if p and p.HasValue else ""
        return dict(self.ref(element), name=str(name), category=self.eid(element.Category.Id) if element.Category else None)

    def outline(self, room):
        options = self.DB.SpatialElementBoundaryOptions()
        options.SpatialElementBoundaryLocation = self.DB.SpatialElementBoundaryLocation.Finish
        try:
            boundaries = room.GetBoundarySegments(options)
            if boundaries is None:
                return []
            return [[{"kind": str(s.GetCurve().GetType().Name),
                      "lengthFt": float(s.GetCurve().Length),
                      "startFt": self.xyz(s.GetCurve().GetEndPoint(0)),
                      "endFt": self.xyz(s.GetCurve().GetEndPoint(1)),
                      "generatorId": self.eid(s.ElementId)} for s in loop] for loop in boundaries]
        finally:
            options.Dispose()

    def input_inventory(self, config):
        room = self.doc.GetElement(config["selected_room_uid"])
        phase = self.doc.GetElement(config["phase_uid"])
        if room is None or not isinstance(room, self.DB.Architecture.Room):
            raise ProbeRefused("Selected UID is not a Room")
        if self.phase(room)["uniqueId"] != config["phase_uid"] or room.DesignOption is not None:
            raise ProbeRefused("Room phase/option mismatch")
        payload = {"room": self.descriptor(room), "roomParameters": self.params(room),
                   "roomOutline": self.outline(room), "projectParameters": self.params(self.doc.ProjectInformation),
                   "phase": self.descriptor(phase), "units": "internal feet; raw parameters retain specTypeId",
                   "windows": [], "rooms": [], "planResources": {}}
        location = self.doc.ActiveProjectLocation
        position = location.GetProjectPosition(self.DB.XYZ.Zero)
        payload["north"] = {"angleFromTrueNorthRadians": float(position.Angle), "projectLocation": self.descriptor(location)}
        for w in self.DB.FilteredElementCollector(self.doc).OfCategory(self.DB.BuiltInCategory.OST_Windows).WhereElementIsNotElementType():
            if not isinstance(w, self.DB.FamilyInstance):
                continue
            f = rr("get_FromRoom(phase)", lambda: self.descriptor(w.get_FromRoom(phase)))
            t = rr("get_ToRoom(phase)", lambda: self.descriptor(w.get_ToRoom(phase)))
            linked_to_room = any(x.get("value") and x["value"]["uniqueId"] == room.UniqueId for x in (f,t))
            row = {"ref": self.descriptor(w), "fromRoom": f, "toRoom": t,
                   "host": self.descriptor(w.Host), "type": self.descriptor(w.Symbol),
                   "lifecycle": self.lifecycle(w), "option": self.option(w)}
            if linked_to_room:
                row.update(parameters=self.params(w), typeParameters=self.params(w.Symbol),
                           location=rr("Location.Point", lambda: self.xyz(w.Location.Point)),
                           facing=self.xyz(w.FacingOrientation), hand=self.xyz(w.HandOrientation))
                if isinstance(w.Host, self.DB.Wall):
                    row["hostParameters"] = self.params(w.Host)
                    row["hostKind"] = str(w.Host.WallType.Kind)
                    row["hostCurve"] = str(w.Host.Location.Curve.GetType().Name)
            payload["windows"].append(row)
        for r in self.DB.FilteredElementCollector(self.doc).OfCategory(self.DB.BuiltInCategory.OST_Rooms).WhereElementIsNotElementType():
            if self.phase(r)["uniqueId"] != config["phase_uid"] or r.DesignOption is not None:
                continue
            loops = self.outline(r)
            payload["rooms"].append(dict(self.descriptor(r), number=str(r.Number), areaFt2=float(r.Area),
                                        levelId=self.eid(r.LevelId), outline=loops))
        for key, cls in (("plans",self.DB.ViewPlan), ("colorSchemes",self.DB.ColorFillScheme),
                         ("textTypes",self.DB.TextNoteType), ("viewTypes",self.DB.ViewFamilyType)):
            payload["planResources"][key] = [dict(self.descriptor(e),
                detail=rr("plan metadata",lambda: {"viewType": str(e.ViewType), "template": bool(e.IsTemplate), "level": self.descriptor(e.GenLevel)}))
                if key == "plans" else self.descriptor(e) for e in self.DB.FilteredElementCollector(self.doc).OfClass(cls)]
        payload["planResources"]["roomTagTypes"] = [dict(self.descriptor(e), family=str(e.FamilyName),parameters=self.params(e))
            for e in self.DB.FilteredElementCollector(self.doc).OfCategory(self.DB.BuiltInCategory.OST_RoomTags).WhereElementIsElementType()]
        return payload


def input_entry(inputs):
    if len(inputs) != 3:
        raise ProbeRefused("Expected config, enabled, nonce")
    canonical_path(inputs[0], ".json")
    if os.path.getsize(inputs[0]) > 65536:
        raise ProbeRefused("Configuration too large")
    with open(inputs[0], encoding="utf-8-sig") as f:
        config = json.load(f)
    required = {"schema","documentGuard","selected_room_uid","phase_uid","evidence_jsonl"}
    if set(config) != required or config["schema"] != "keo-dynamo-inputs-config/v1":
        raise ProbeRefused("Unexpected configuration")
    canonical_path(config["evidence_jsonl"], ".jsonl")
    guard = run_probe(config["documentGuard"], inputs[1], inputs[2], InputHost)
    result = {"schema":"keo-dynamo-inputs-evidence/v1", "status":guard["status"],"guard":guard,
              "bundleSha256":BUNDLE_SHA256,"geometryAccepted":False,"normativeAccepted":False,
              "runNonce":str(inputs[2]),"modelWriteRequested":False}
    if guard["status"] == "READ_ONLY_OK":
        host = InputHost()
        try:
            if host.snapshot() != guard["after"]:
                raise ProbeRefused("Changed document before inventory")
            result["payload"] = host.input_inventory(config)
            result["payloadSha256"] = hashlib.sha256(json.dumps(result["payload"],ensure_ascii=False,sort_keys=True).encode("utf-8")).hexdigest()
            result["status"] = "INPUT_CANDIDATES_CAPTURED"
        except Exception as exc:
            result.update(status="ERROR",reason=type(exc).__name__+": "+str(exc))
        finally:
            result["after"] = host.snapshot()
            result["documentUnchanged"] = result["after"] == guard["before"]
            if not result["documentUnchanged"]:
                result.update(status="ERROR",reason="Document changed during inventory")
    output = config["evidence_jsonl"]
    if os.path.exists(output):
        if os.path.getsize(output)>10*1024*1024:
            raise ProbeRefused("Evidence log too large")
        with open(output,encoding="utf-8") as f:
            if any(json.loads(line).get("schema")!=result["schema"] for line in f if line.strip()):
                raise ProbeRefused("Unexpected existing evidence")
    with open(output,"a",encoding="utf-8",newline="\n") as f:
        f.write(json.dumps(result,ensure_ascii=False,sort_keys=True)+"\n")
    return json.dumps({k:v for k,v in result.items() if k not in ("payload","guard","after")},ensure_ascii=False,indent=2)


"""Bounded native section measurements; never a daylight or shading solver."""
import math


def validate_section_probe(request, available_uids):
    if not isinstance(request,dict) or set(request)!={"element_uids","segments_m","room_points_m"}:
        raise ValueError("Section probe requires explicit elements, metre segments and room points")
    uids=request["element_uids"]
    if (not isinstance(uids,list) or not 1<=len(uids)<=8 or
        any(not isinstance(u,str) or not u for u in uids) or
        len(set(uids))!=len(uids) or not set(uids)<=set(available_uids)):
        raise ValueError("Probe elements must be 1..8 unique captured candidates")
    def point(p):
        if (not isinstance(p,list) or len(p)!=3 or
            any(type(v) not in (int,float) or not math.isfinite(v) for v in p)):
            raise ValueError("Finite XYZ metres required")
    segments=request["segments_m"]
    if not isinstance(segments,list) or not 1<=len(segments)<=48:
        raise ValueError("1..48 explicit section segments required")
    for s in segments:
        if not isinstance(s,list) or len(s)!=2:raise ValueError("Segment needs two endpoints")
        point(s[0]);point(s[1])
        if not 0.001<=math.dist(s[0],s[1])<=100:
            raise ValueError("Section segment length must be between 1 mm and 100 m")
    points=request["room_points_m"]
    if not isinstance(points,list) or len(points)>16:raise ValueError("At most 16 room points")
    for p in points:point(p)
    return request


def read_section_probe(host, room, request, available_uids):
    validate_section_probe(request,available_uids)
    DB=host.DB
    xyz=lambda p:DB.XYZ(*(v/0.3048 for v in p))
    metres=lambda p:[float(p.X)*0.3048,float(p.Y)*0.3048,float(p.Z)*0.3048]
    result={"units":"root Revit internal axes, metres","request":request,
        "roomPoints":[{"pointM":p,"inside":bool(room.IsPointInRoom(xyz(p)))} for p in request["room_points_m"]],
        "elements":[],"geometryAccepted":False,"shadingAccepted":False,
        "scope":"Explicit finite segments and elements only; no proof of unobstructed sky or complete aperture"}
    curves=[]
    options=DB.Options()
    options.DetailLevel=DB.ViewDetailLevel.Fine
    options.IncludeNonVisibleObjects=False
    options.ComputeReferences=False
    identity=DB.Transform.Identity
    intersections=DB.SolidCurveIntersectionOptions()
    intersections.ResultType=DB.SolidCurveIntersectionMode.CurveSegmentsInside
    try:
        curves=[DB.Line.CreateBound(xyz(s[0]),xyz(s[1])) for s in request["segments_m"]]
        for uid in request["element_uids"]:
            element=host.doc.GetElement(uid)
            if element is None:raise ValueError("Probe element no longer exists")
            record={"ref":host.descriptor(element),"lifecycle":host.lifecycle(element),
                "option":host.option(element),"solids":0,"hits":[],"otherGeometry":[]}
            count=[0]
            def solid(s,transform,key):
                if s.Faces.Size==0:return
                count[0]+=s.Faces.Size
                if count[0]>10000:raise ValueError("Section element face limit exceeded")
                world=DB.SolidUtils.CreateTransformed(s,transform)
                try:
                    if world.Volume<=0:raise ValueError("Section target contains a non-volume solid")
                    record["solids"]+=1
                    for index,line in enumerate(curves):
                        hit=world.IntersectWithCurve(line,intersections)
                        try:
                            for j in range(hit.SegmentCount):
                                segment=hit.GetCurveSegment(j)
                                try:
                                    record["hits"].append({"segment":index,"geometryPath":list(key),
                                        "startM":metres(segment.GetEndPoint(0)),"endM":metres(segment.GetEndPoint(1)),
                                        "lengthM":float(segment.Length)*0.3048})
                                finally:segment.Dispose()
                        finally:hit.Dispose()
                finally:world.Dispose()
            def other(obj,key):
                record["otherGeometry"].append({"geometryPath":list(key),"type":str(obj.GetType().FullName)})
            geometry=element.get_Geometry(options)
            try:
                if geometry is None:raise ValueError("No target geometry available")
                walk_symbol_geometry(geometry,identity,DB,solid,other)
            finally:
                if geometry is not None:geometry.Dispose()
            result["elements"].append(record)
    finally:
        for line in curves:line.Dispose()
        intersections.Dispose();identity.Dispose();options.Dispose()
    return result

"""Targeted read-only profile inspection on a clean file or recorded D5 state.

No transactions, model writes or saving. The complete current snapshot must
equal the successful apply evidence; all profile inputs are reread.
This inspects candidate dimensions, not geometry/normative acceptance.
"""

def profile_baseline(config, host):
    mode=config.get("baseline_mode", "recorded-apply")
    if mode=="recorded-apply":
        return recorded_baseline(config,host)
    if mode!="clean-file":
        raise ProbeRefused("Unknown profile baseline mode")
    if "apply_evidence_jsonl" in config or "apply_nonce" in config:
        raise ProbeRefused("Clean-file baseline cannot include historical apply evidence")
    guard=run_probe(config["documentGuard"],True,"profile-clean-file",lambda:host)
    if guard["status"]!="READ_ONLY_OK":
        raise ProbeRefused("Clean-file guard: "+guard.get("reason",guard["status"]))
    current=host.snapshot()
    if current!=guard["after"]:
        raise ProbeRefused("Document changed after clean-file guard")
    return current

def recorded_baseline(config, host):
    validate_config(config["documentGuard"])
    canonical_path(config["apply_evidence_jsonl"], ".jsonl")
    identity=host.identity()
    guard=config["documentGuard"]
    if canonical_path(identity["path"],".rvt")!=canonical_path(guard["expected_rvt_path"],".rvt"):
        raise ProbeRefused("Wrong active test document")
    if (identity["revitVersion"],identity["revitBuild"])!=(guard["expected_revit_version"],guard["expected_revit_build"]):
        raise ProbeRefused("Wrong Revit version/build")
    with open(config["apply_evidence_jsonl"],encoding="utf-8") as f:
        records=[json.loads(line) for line in f if line.strip()]
    matches=[r for r in records if r.get("status")=="PENDING_PLAN_APPLIED" and r.get("nonce")==str(config["apply_nonce"])]
    if len(matches)!=1: raise ProbeRefused("One exact successful diagnostic apply required")
    baseline=matches[0]["after"]
    current=host.snapshot()
    if current!=baseline or current["sha256"].lower()!=guard["expected_sha256"].lower():
        raise ProbeRefused("Current state differs from recorded diagnostic apply: "+json.dumps({k:[baseline[k],current[k]] for k in baseline if baseline[k]!=current[k]}))
    if any(current[k] for k in ("isModifiable","isWorkshared","isLinked","isFamilyDocument","isModelInCloud")):
        raise ProbeRefused("Unsupported document state")
    return current


def detail_selection(config, window_uids):
    """Only explicitly selected, already captured windows; never a scene export."""
    selected=config.get("detail_window_uids",[])
    if not isinstance(selected,list) or len(selected)>3 or any(not isinstance(x,str) or not x for x in selected):
        raise ProbeRefused("At most three explicit window UIDs required")
    if len(set(selected))!=len(selected) or not set(selected).issubset(set(window_uids)):
        raise ProbeRefused("Detail selection must be unique captured windows")
    return selected


class ProfileHost(InputHost):
    def bbox(self, element):
        box=element.get_BoundingBox(None)
        return None if box is None else {"min":self.xyz(box.Min),"max":self.xyz(box.Max)}

    def profile(self, config):
        DB=self.DB
        room=self.doc.GetElement(config["room_uid"])
        phase=self.doc.GetElement(config["phase_uid"])
        if not isinstance(room,DB.Architecture.Room) or self.phase(room)["uniqueId"]!=config["phase_uid"] or room.DesignOption is not None:
            raise ProbeRefused("Placed main-model Room in selected phase required")
        if room.Area<=0 or room.Location is None:raise ProbeRefused("Room not enclosed/placed")
        rb=self.bbox(room)
        out={"room":self.descriptor(room),"parameters":self.params(room),"outline":self.outline(room),
             "locationFt":self.xyz(room.Location.Point),"bbox":rb,"phase":self.descriptor(phase),
             "northRadians":float(self.doc.ActiveProjectLocation.GetProjectPosition(DB.XYZ.Zero).Angle),
             "windows":[],"hosts":[],"units":"feet; raw parameters include specTypeId"}
        transform=self.doc.ActiveProjectLocation.GetTotalTransform()
        out["projectTransform"]={"basisX":self.xyz(transform.BasisX),"basisY":self.xyz(transform.BasisY),"origin":self.xyz(transform.Origin)}
        hosts=set()
        for w in DB.FilteredElementCollector(self.doc).OfCategory(DB.BuiltInCategory.OST_Windows).WhereElementIsNotElementType():
            if not isinstance(w,DB.FamilyInstance):continue
            f=rr("FromRoom(phase)",lambda:self.descriptor(w.get_FromRoom(phase)))
            t=rr("ToRoom(phase)",lambda:self.descriptor(w.get_ToRoom(phase)))
            wb=self.bbox(w)
            related=any(v.get("value") and v["value"]["uniqueId"]==room.UniqueId for v in (f,t))
            near=wb is not None and all(wb["max"][i]>=rb["min"][i]-1 and wb["min"][i]<=rb["max"][i]+1 for i in (0,1))
            if not related and not near:continue
            out["windows"].append({"ref":self.descriptor(w),"fromRoom":f,"toRoom":t,"bbox":wb,
                "related":related,"nearXY":near,"parameters":self.params(w),"typeParameters":self.params(w.Symbol),
                "host":self.descriptor(w.Host),"lifecycle":self.lifecycle(w),"option":self.option(w),
                "facing":self.xyz(w.FacingOrientation),"hand":self.xyz(w.HandOrientation)})
            if w.Host is not None:hosts.add(w.Host.UniqueId)
        for uid in sorted(hosts):
            wall=self.doc.GetElement(uid)
            row={"ref":self.descriptor(wall),"bbox":self.bbox(wall),"parameters":self.params(wall)}
            if isinstance(wall,DB.Wall):
                curve=wall.Location.Curve
                row.update(kind=str(wall.WallType.Kind),curve=str(curve.GetType().Name),
                    startFt=self.xyz(curve.GetEndPoint(0)),endFt=self.xyz(curve.GetEndPoint(1)),
                    widthFt=float(wall.Width),lengthFt=float(curve.Length),orientation=self.xyz(wall.Orientation))
                if wall.CurtainGrid is not None:
                    row["panels"]=[{"ref":self.descriptor(p),"bbox":self.bbox(p),"parameters":self.params(p),
                        "typeParameters":self.params(self.doc.GetElement(p.GetTypeId()))}
                        for p in [self.doc.GetElement(eid) for eid in wall.CurtainGrid.GetPanelIds()]]
            out["hosts"].append(row)
        # Local overhang candidates only: no claim of complete remote shading.
        # Read nearby upper slabs/roofs to identify the exact geometry needed
        # for the calculator's overhang fields; do not export a scene mesh.
        out["localShadingCandidates"]=[]
        pad=20.0
        for bic in (DB.BuiltInCategory.OST_Floors,DB.BuiltInCategory.OST_Roofs,DB.BuiltInCategory.OST_GenericModel):
            for e in DB.FilteredElementCollector(self.doc).OfCategory(bic).WhereElementIsNotElementType():
                box=self.bbox(e)
                if box is None or box["max"][2]<=rb["min"][2]+2:continue
                if not all(box["max"][i]>=rb["min"][i]-pad and box["min"][i]<=rb["max"][i]+pad for i in (0,1)):continue
                out["localShadingCandidates"].append({"ref":self.descriptor(e),"bbox":box,"parameters":self.params(e),"lifecycle":self.lifecycle(e)})
        out["shadingScope"]={"kind":"local-candidates-only","paddingFt":pad,"remoteObstaclesAccepted":False}
        selected=detail_selection(config,[w["ref"]["uniqueId"] for w in out["windows"]])
        if selected:
            detail_host=D2Host()
            out["windowDetails"]=[{"uid":uid,"location":rr("Location",lambda: self.xyz(self.doc.GetElement(uid).Location.Point)),
                "geometry":rr("Selected window geometry",lambda:detail_host.physical_geometry(self.doc.GetElement(uid),room))}
                for uid in selected]
        if config.get("section_probe") is not None:
            available=[w["ref"]["uniqueId"] for w in out["windows"]]+[e["ref"]["uniqueId"] for e in out["localShadingCandidates"]]
            out["sectionProbe"]=read_section_probe(self,room,config["section_probe"],available)
        return out


def profile_entry(inputs):
    if len(inputs)!=3 or type(inputs[1]) is not bool:raise ProbeRefused("Expected config, Boolean, nonce")
    canonical_path(inputs[0],".json")
    with open(inputs[0],encoding="utf-8-sig") as f:config=json.load(f)
    result={"schema":"keo-profile-read/v1","status":"CANCELLED","nonce":str(inputs[2]),
            "modelWriteRequested":False,"geometryAccepted":False,"bundleSha256":BUNDLE_SHA256}
    canonical_path(config["output_json"],".json")
    if inputs[1]:
        host=ProfileHost()
        before=profile_baseline(config,host)
        payload=host.profile(config)
        after=host.snapshot()
        if before!=after:raise ProbeRefused("Document changed during read")
        result.update(status="PROFILE_CAPTURED",before=before,after=after,payload=payload,documentUnchanged=True)
        result["payloadSha256"]=hashlib.sha256(json.dumps(payload,ensure_ascii=False,sort_keys=True).encode("utf-8")).hexdigest()
        with open(config["output_json"],"w",encoding="utf-8") as f:json.dump(result,f,ensure_ascii=False,indent=2)
    return json.dumps({k:v for k,v in result.items() if k not in ("payload","before","after")},ensure_ascii=False,indent=2)


"""Read-only shaft review: saved profile and conservative above-aperture inventory.

Bounding boxes identify possible blockers, never prove an obstruction or KEO.
No model constants, transactions, acceptance flags or automatic repairs.
"""
import math


def validate_sky_review(request, captured_window_uids):
    if not isinstance(request, dict) or set(request) != {"aperture_top_z_m", "aperture_center_xy_m", "self_window_uid"}:
        raise ProbeRefused("Explicit aperture elevation, centre and captured window required")
    z, xy = request["aperture_top_z_m"], request["aperture_center_xy_m"]
    if type(z) not in (int, float) or not math.isfinite(z):
        raise ProbeRefused("Finite aperture elevation required")
    if not isinstance(xy, list) or len(xy) != 2 or any(type(v) not in (int, float) or not math.isfinite(v) for v in xy):
        raise ProbeRefused("Finite XY centre required")
    if request["self_window_uid"] not in captured_window_uids:
        raise ProbeRefused("Self element must be a captured window")
    return request


def above_aperture_metrics(box_m, center_xy, plane_z):
    if box_m is None:
        return None
    lo, hi = box_m["min"], box_m["max"]
    if (len(lo) != 3 or len(hi) != 3 or
            any(not math.isfinite(v) for v in lo + hi) or any(lo[i] > hi[i] for i in range(3))):
        raise ProbeRefused("Invalid candidate bounding box")
    if hi[2] <= plane_z:
        return None
    dx = max(lo[0] - center_xy[0], center_xy[0] - hi[0], 0)
    dy = max(lo[1] - center_xy[1], center_xy[1] - hi[1], 0)
    distance = math.hypot(dx, dy)
    return {"aboveM": hi[2] - plane_z, "nearestHorizontalM": distance,
            "upperElevationDeg": math.degrees(math.atan2(hi[2] - plane_z, distance))}


class ShaftReviewHost(ProfileHost):
    def geometry_presence(self, element):
        DB = self.DB
        opts = DB.Options()
        opts.DetailLevel = DB.ViewDetailLevel.Fine
        opts.IncludeNonVisibleObjects = False
        out = {"positiveSolids": 0, "meshTriangles": 0, "otherTypes": {}}
        geometry = None
        def visit(items):
            if items is None:
                return
            for item in items:
                if isinstance(item, DB.GeometryInstance):
                    child = item.GetSymbolGeometry()
                    try:
                        visit(child)
                    finally:
                        if child is not None: child.Dispose()
                elif isinstance(item, DB.Solid):
                    if item.Faces.Size and item.Volume > 0: out["positiveSolids"] += 1
                elif isinstance(item, DB.Mesh):
                    out["meshTriangles"] += int(item.NumTriangles)
                else:
                    name = str(item.GetType().FullName)
                    out["otherTypes"][name] = out["otherTypes"].get(name, 0) + 1
        try:
            geometry = element.get_Geometry(opts)
            visit(geometry)
            out["geometryReturned"] = geometry is not None
            return out
        finally:
            if geometry is not None: geometry.Dispose()
            opts.Dispose()

    def review_descriptor(self, element):
        out = self.descriptor(element)
        out["nativeType"] = str(element.GetType().FullName)
        out["categoryName"] = str(element.Category.Name) if element.Category else None
        return out

    def sky_review(self, request, payload):
        request = validate_sky_review(request, [w["ref"]["uniqueId"] for w in payload["windows"]])
        DB = self.DB
        self_element = self.doc.GetElement(request["self_window_uid"])
        self_ids = {self_element.UniqueId}
        if isinstance(self_element, DB.FamilyInstance):
            self_ids.update(self.doc.GetElement(i).UniqueId for i in self_element.GetSubComponentIds())
        out = {"request": request, "candidates": [], "missingBounds": [], "externalReferences": [], "excludedNativeTypes": {},
               "selfElements": sorted(self_ids), "modelElementsChecked": 0,
               "shadingAccepted": False, "scope": "All root model bounding boxes above the upper aperture; no distance cutoff. Candidates need geometry review. External/reference completeness is separate."}
        # A Revit Family is a definition, but is NOT an ElementType. Likewise,
        # views/materials can have CategoryType.Model. They are not obstacles.
        nonphysical = (DB.Architecture.Room, DB.Area, DB.View, DB.Family,
                       DB.Material, DB.ProjectInfo, DB.SunAndShadowSettings,
                       DB.PropertySetElement, DB.Plumbing.PipeSegment, DB.CurtainGridLine)
        nonphysical_categories = {DB.ElementId(b).Value for b in (
            DB.BuiltInCategory.OST_Cameras, DB.BuiltInCategory.OST_PreviewLegendComponents,
            DB.BuiltInCategory.OST_CurtaSystemFaceManager)}
        for e in DB.FilteredElementCollector(self.doc).WhereElementIsNotElementType():
            if isinstance(e, (DB.RevitLinkInstance, DB.ImportInstance)):
                out["externalReferences"].append({"ref": self.review_descriptor(e), "bbox": self.bbox(e),
                    "kind": str(e.GetType().Name), "lifecycle": self.lifecycle(e)})
            if isinstance(e, nonphysical) or (e.Category and e.Category.Id.Value in nonphysical_categories):
                native = str(e.GetType().FullName)
                out["excludedNativeTypes"][native] = out["excludedNativeTypes"].get(native, 0) + 1
                continue
            if e.Category is None or e.Category.CategoryType != DB.CategoryType.Model or e.ViewSpecific:
                continue
            out["modelElementsChecked"] += 1
            if e.UniqueId in self_ids:
                continue
            box = self.bbox(e)
            if box is None:
                row = self.review_descriptor(e)
                row.update(geometry=self.geometry_presence(e), lifecycle=self.lifecycle(e), option=self.option(e))
                out["missingBounds"].append(row)
                continue
            box_m = {k: [v * 0.3048 for v in box[k]] for k in ("min", "max")}
            metrics = above_aperture_metrics(box_m, request["aperture_center_xy_m"], request["aperture_top_z_m"])
            if metrics is not None:
                out["candidates"].append({"ref": self.review_descriptor(e), "bboxM": box_m, "bounds": metrics,
                    "lifecycle": self.lifecycle(e), "option": self.option(e)})
            if len(out["candidates"]) > 3000 or len(out["missingBounds"]) > 3000:
                raise ProbeRefused("Review inventory limit exceeded; no partial success")
        out["candidates"].sort(key=lambda r: (-r["bounds"]["upperElevationDeg"], r["ref"]["uniqueId"]))
        return out

    def tag_inventory(self, room_uid):
        DB = self.DB
        room = self.doc.GetElement(room_uid)
        return {"types": [{"ref": self.descriptor(t), "family": str(t.Family.Name), "parameters": self.params(t)}
                          for t in DB.FilteredElementCollector(self.doc).OfCategory(DB.BuiltInCategory.OST_RoomTags).WhereElementIsElementType()
                          if isinstance(t, DB.FamilySymbol)],
                "roomParameters": self.params(room)}


def shaft_review_entry(inputs):
    if len(inputs) != 3 or type(inputs[1]) is not bool:
        raise ProbeRefused("Expected config, Boolean and nonce")
    canonical_path(inputs[0], ".json")
    with open(inputs[0], encoding="utf-8-sig") as f:
        config = json.load(f)
    canonical_path(config["output_json"], ".json")
    result = {"schema": "keo-shaft-review/v1", "status": "CANCELLED", "nonce": str(inputs[2]),
              "bundleSha256": BUNDLE_SHA256, "modelWriteRequested": False, "geometryAccepted": False}
    if inputs[1]:
        host = ShaftReviewHost()
        before = profile_baseline(config, host)
        payload = host.profile(config)
        payload["skyReview"] = host.sky_review(config["sky_review"], payload)
        payload["tagInventory"] = host.tag_inventory(config["room_uid"])
        after = host.snapshot()
        if before != after:
            raise ProbeRefused("Document changed during shaft review")
        result.update(status="SHAFT_REVIEW_CAPTURED", before=before, after=after, payload=payload, documentUnchanged=True)
        result["payloadSha256"] = hashlib.sha256(json.dumps(payload, ensure_ascii=False, sort_keys=True).encode("utf-8")).hexdigest()
        with open(config["output_json"], "w", encoding="utf-8") as f:
            json.dump(result, f, ensure_ascii=False, indent=2)
    return json.dumps({k: v for k, v in result.items() if k not in ("payload", "before", "after")}, ensure_ascii=False, indent=2)


if "IN" in globals():
    try:
        OUT = shaft_review_entry(IN)
    except Exception as exc:
        OUT = json.dumps({"status": "ERROR", "reason": type(exc).__name__ + ": " + str(exc)}, ensure_ascii=False)
# ----------------------------------------
d4_shaft_summary = Watch(d4_shaft_review)  # graph output
