# Dynamo graph KEO_D5_PendingPlan.dyn "KEO D5 - Pending plan" (Dynamo 4.2.1.5887)
# author: keo-calc
# Explicit preview / rollback / apply. Gray diagnostic status only. No numeric KEO; no RVT save.

config_json_path_local_only = StringInput("")  # graph input
read_test_rvt_false_cancel = BoolSelector(false)  # graph input
run_number_change_to_repeat = IntegerSlider(0, range=0..1000 step 1)  # graph input
d5_pending_plan = Python(IN[0]=config_json_path_local_only, IN[1]=read_test_rvt_false_cancel, IN[2]=run_number_change_to_repeat)  # PythonNet3
# ---------- d5_pending_plan.python (943 lines) ----------
BUNDLE_SHA256 = "8b4c88c9975dad707181859bec1138f9966a552394737075c458cbedb2afc35b"
"""D0: read-only environment probe for Dynamo PythonNet3. No model writes.

IN: absolute config JSON path, enabled Boolean, run nonce (change to rerun).
OUT: JSON evidence. Configuration and runtime evidence are private local files.
"""
import datetime
import json
import ntpath
import os
import re
import sys
import uuid

PROBE_VERSION = "0.1.0"
SOURCE_SHA256 = globals().get("SOURCE_SHA256", "unbundled")


class ProbeRefused(Exception):
    pass


def canonical_path(value, extension):
    if not isinstance(value, str) or not ntpath.isabs(value):
        raise ProbeRefused("An absolute local path is required")
    path = ntpath.normpath(value)
    if path.startswith("\\\\") or ntpath.splitext(path)[1].lower() != extension:
        raise ProbeRefused("Wrong file extension or non-local path")
    return ntpath.normcase(path)


def validate_config(config):
    required = {"schema", "expected_rvt_path", "expected_sha256", "expected_revit_version", "expected_revit_build"}
    optional = {"evidence_jsonl"}
    if not isinstance(config, dict) or set(config) - required - optional or not required <= set(config):
        raise ProbeRefused("Unexpected or missing configuration fields")
    if config["schema"] != "keo-dynamo-d0-config/v1":
        raise ProbeRefused("Unsupported configuration schema")
    target = canonical_path(config["expected_rvt_path"], ".rvt")
    if not isinstance(config["expected_sha256"], str) or not re.fullmatch(r"[0-9a-fA-F]{64}", config["expected_sha256"]):
        raise ProbeRefused("An independently recorded RVT SHA-256 is required")
    for key in ("expected_revit_version", "expected_revit_build"):
        if not isinstance(config[key], str) or not config[key].strip():
            raise ProbeRefused("An explicit Revit version/build is required")
    if config.get("evidence_jsonl"):
        canonical_path(config["evidence_jsonl"], ".jsonl")
    return target


def run_probe(config, enabled, nonce, host_factory):
    result = {
        "schema": "keo-dynamo-d0-evidence/v1", "probeVersion": PROBE_VERSION,
        "sourceSha256": SOURCE_SHA256, "runId": str(uuid.uuid4()),
        "runNonce": str(nonce), "utc": datetime.datetime.now(datetime.timezone.utc).isoformat(),
        "status": "ERROR", "modelAccepted": False, "geometryAccepted": False,
        "normativeAccepted": False, "modelWriteRequested": False,
    }
    host = None
    before = None
    try:
        target = validate_config(config)
        if type(enabled) is not bool:
            raise ProbeRefused("Enabled must be a Boolean")
        if not enabled:
            result.update(status="CANCELLED", reason="Disabled before accessing Revit")
            return result
        host = host_factory()
        identity = host.identity()
        if canonical_path(identity["path"], ".rvt") != target:
            raise ProbeRefused("Active document does not match the explicitly selected test RVT")
        if identity["revitVersion"] != config["expected_revit_version"] or identity["revitBuild"] != config["expected_revit_build"]:
            raise ProbeRefused("Revit version/build mismatch")
        # Runtime metadata is diagnostic even if the document fails the guard.
        result["environment"] = host.environment()
        before = host.snapshot()
        result["before"] = before
        if any(before[key] for key in ("isModified", "isModifiable", "isWorkshared", "isLinked", "isFamilyDocument", "isModelInCloud")):
            raise ProbeRefused("Only unchanged saved standalone local root RVT is supported by D0")
        if before["sha256"].lower() != config["expected_sha256"].lower():
            raise ProbeRefused("RVT differs from the independently recorded SHA-256")
        result["document"] = identity
        result["roomCount"] = host.room_count()
        result["status"] = "READ_ONLY_OK"
    except ProbeRefused as exc:
        result.update(status="REFUSED", reason=str(exc))
    except Exception as exc:
        result.update(status="ERROR", reason=type(exc).__name__ + ": " + str(exc))
    finally:
        if host is not None and before is not None:
            try:
                after = host.snapshot()
                result["after"] = after
                result["documentUnchanged"] = before == after
                if before != after:
                    result.update(status="ERROR", reason="Document/file changed during probe")
            except Exception as exc:
                result.update(status="ERROR", documentUnchanged=False,
                              reason="Post-check failed: " + type(exc).__name__ + ": " + str(exc))
    return result


class RevitHost:
    def __init__(self):
        import clr
        clr.AddReference("RevitAPI")
        clr.AddReference("RevitServices")
        from RevitServices.Persistence import DocumentManager
        from Autodesk.Revit import DB
        self.DB = DB
        self.manager = DocumentManager.Instance
        self.doc = self.manager.CurrentDBDocument
        self.ui = self.manager.CurrentUIApplication
        if self.doc is None or self.ui is None or self.ui.ActiveUIDocument is None:
            raise ProbeRefused("No active Revit document")
        if not self.doc.Equals(self.ui.ActiveUIDocument.Document):
            raise ProbeRefused("Dynamo and Revit active documents differ")

    def identity(self):
        app = self.ui.Application
        return {"path": str(self.doc.PathName), "title": str(self.doc.Title),
                "revitVersion": str(app.VersionNumber), "revitBuild": str(app.VersionBuild)}

    def snapshot(self):
        from System import BitConverter
        from System.IO import FileStream, FileMode, FileAccess, FileShare
        from System.Security.Cryptography import SHA256
        if not self.doc.IsValidObject or not self.doc.Equals(self.manager.CurrentDBDocument) or not self.doc.Equals(self.ui.ActiveUIDocument.Document):
            raise ProbeRefused("Active document changed")
        path = str(self.doc.PathName)
        canonical_path(path, ".rvt")
        version = self.DB.Document.GetDocumentVersion(self.doc)
        try:
            result = {"path": path, "versionGuid": str(version.VersionGUID),
                      "numberOfSaves": int(version.NumberOfSaves)}
        finally:
            version.Dispose()
        for name in ("IsModified", "IsModifiable", "IsWorkshared", "IsLinked", "IsFamilyDocument", "IsModelInCloud"):
            result[name[0].lower() + name[1:]] = bool(getattr(self.doc, name))
        stream = FileStream(path, FileMode.Open, FileAccess.Read, FileShare.ReadWrite)
        hasher = SHA256.Create()
        try:
            result["fileLength"] = int(stream.Length)
            result["sha256"] = str(BitConverter.ToString(hasher.ComputeHash(stream))).replace("-", "").lower()
        finally:
            hasher.Dispose()
            stream.Dispose()
        return result

    def environment(self):
        import platform
        from System import AppDomain, Environment
        from System.Diagnostics import FileVersionInfo, Process
        names = {"DynamoCore", "DynamoRevitDS", "RevitAPI", "RevitServices", "Python.Runtime", "DSPythonNet3"}
        assemblies = []
        for assembly in AppDomain.CurrentDomain.GetAssemblies():
            name = str(assembly.GetName().Name)
            if name in names:
                info = FileVersionInfo.GetVersionInfo(assembly.Location)
                assemblies.append({"name": name, "assemblyVersion": str(assembly.GetName().Version),
                                   "fileVersion": str(info.FileVersion)})
        return {"python": sys.version, "pythonImplementation": platform.python_implementation(),
                "dotnet": str(Environment.Version), "processId": int(Process.GetCurrentProcess().Id),
                "assemblies": sorted(assemblies, key=lambda item: item["name"])}

    def room_count(self):
        collector = self.DB.FilteredElementCollector(self.doc).OfCategory(self.DB.BuiltInCategory.OST_Rooms).WhereElementIsNotElementType()
        try:
            return int(collector.GetElementCount())
        finally:
            collector.Dispose()


def dynamo_entry(inputs):
    if len(inputs) != 3:
        raise ProbeRefused("Expected configuration path, enabled Boolean and run nonce")
    path = inputs[0]
    canonical_path(path, ".json")
    if os.path.getsize(path) > 65536:
        raise ProbeRefused("Configuration exceeds 64 KiB")
    with open(path, "r", encoding="utf-8-sig") as stream:
        config = json.load(stream)
    result = run_probe(config, inputs[1], inputs[2], RevitHost)
    # Append only to an explicit local evidence log; never open the RVT for writing.
    # Invalid configuration cannot grant permission to write an output file.
    validate_config(config)
    if config.get("evidence_jsonl"):
        output = config["evidence_jsonl"]
        if os.path.exists(output):
            if os.path.getsize(output) > 10 * 1024 * 1024:
                raise ProbeRefused("Evidence log exceeds 10 MiB")
            with open(output, "r", encoding="utf-8") as stream:
                for line in stream:
                    if line.strip() and json.loads(line).get("schema") != result["schema"]:
                        raise ProbeRefused("Existing file is not a D0 evidence log")
        with open(output, "a", encoding="utf-8", newline="\n") as stream:
            stream.write(json.dumps(result, ensure_ascii=False, sort_keys=True) + "\n")
    return json.dumps(result, ensure_ascii=False, indent=2, sort_keys=True)


"""D1 diagnostic Room capture. Root standalone only; never writes a Revit document.

The generator embeds the tested D0 host/guards. Offline imports use the same file.
This is a stage-specific diagnostic schema, not the older SDK codec or KEO input.
"""
import hashlib
import math
if "RevitHost" not in globals():
    from d0_probe import (RevitHost, ProbeRefused, canonical_path, validate_config,
                          datetime, json, os, uuid)

D1_VERSION = "0.1.0"
D1_SCHEMA = "keo-dynamo-d1-evidence/v1"
BUNDLE_SHA256 = globals().get("BUNDLE_SHA256", "unbundled")
BASE_FIELDS = {"expected_rvt_path", "expected_sha256", "expected_revit_version", "expected_revit_build"}


def base_config(config):
    return dict({key: config[key] for key in BASE_FIELDS}, schema="keo-dynamo-d0-config/v1")


def validate_d1(config):
    required = BASE_FIELDS | {"schema", "mode", "evidence_jsonl"}
    optional = {"sample_element_id", "phase_uid", "parameter", "value", "selected_room_uid"}
    if not isinstance(config, dict) or not required <= set(config) or set(config) - required - optional:
        raise ProbeRefused("Missing or unknown D1 configuration fields")
    if config["schema"] != "keo-dynamo-d1-config/v1" or config["mode"] not in ("inventory", "capture"):
        raise ProbeRefused("Unsupported D1 schema/mode")
    target = validate_config(base_config(config))
    canonical_path(config["evidence_jsonl"], ".jsonl")
    if config["mode"] == "inventory":
        if not str(config.get("sample_element_id", "")).isdigit():
            raise ProbeRefused("Inventory requires an explicit sample element id")
    else:
        for key in ("phase_uid", "selected_room_uid"):
            if not isinstance(config.get(key), str) or not config[key]:
                raise ProbeRefused("Explicit phase and selected Room UniqueId required")
        selector = config.get("parameter")
        if not isinstance(selector, dict) or set(selector) != {"kind", "key"}:
            raise ProbeRefused("Parameter selector requires kind and key")
        if selector["kind"] == "id":
            if not isinstance(selector["key"], str) or not selector["key"].lstrip("-").isdigit():
                raise ProbeRefused("Parameter id must be a decimal string")
        elif selector["kind"] == "guid":
            try:
                uuid.UUID(selector["key"])
            except (ValueError, TypeError, AttributeError):
                raise ProbeRefused("Invalid shared parameter GUID")
        else:
            raise ProbeRefused("Select parameter by id/GUID, never by localized name")
        if "value" not in config or type(config["value"]) not in (str, int, float):
            raise ProbeRefused("Explicit typed parameter value required")
        if isinstance(config["value"], float) and not math.isfinite(config["value"]):
            raise ProbeRefused("Non-finite filter value")
    return target


def matches_parameter(parameter, expected):
    if parameter is None or not parameter.get("hasValue"):
        return False
    storage = parameter["storageType"]
    value = parameter["value"]
    if storage == "String":
        return type(expected) is str and value == expected
    if storage == "Integer":
        return type(expected) is int and value == expected
    if storage == "Double":
        return type(expected) in (float, int) and math.isfinite(expected) and value == expected
    if storage == "ElementId":
        return type(expected) is str and value == expected
    raise ProbeRefused("Unsupported filter storage type")


def select_room(rows, phase_uid, expected, selected_uid):
    scoped = [row for row in rows if row["phase"]["uniqueId"] == phase_uid]
    matched = [row for row in scoped if matches_parameter(row["filterParameter"], expected)]
    selected = [row for row in matched if row["ref"]["uniqueId"] == selected_uid]
    if len(selected) != 1:
        raise ProbeRefused("Selected Room must occur exactly once in the phase/parameter result")
    counts = {"phaseRooms": len(scoped), "matchedRooms": len(matched),
              "missingParameter": sum(row["filterParameter"] is None for row in scoped),
              "emptyParameter": sum(row["filterParameter"] is not None and
                                    (not row["filterParameter"]["hasValue"] or row["filterParameter"]["value"] in (None, "")) for row in scoped)}
    return selected[0], counts


def rr(source, function):
    try:
        return {"status": "ok", "source": source, "value": function()}
    except Exception as exc:
        return {"status": "error", "source": source, "reason": type(exc).__name__ + ": " + str(exc)}


def unavailable(source, reason, status="unavailable"):
    return {"status": status, "source": source, "reason": reason}


class D1Host(RevitHost):
    @staticmethod
    def eid(value):
        return str(value.Value)

    @staticmethod
    def xyz(value):
        return [float(value.X), float(value.Y), float(value.Z)]

    def ref(self, element):
        if element is None:
            raise ProbeRefused("Unresolved element reference")
        return {"documentKey": str(element.Document.ProjectInformation.UniqueId),
                "uniqueId": str(element.UniqueId), "elementId": self.eid(element.Id)}

    def resolve(self, eid, doc=None):
        el = (doc or self.doc).GetElement(eid)
        return self.ref(el) if el is not None else None

    def param(self, parameter):
        if parameter is None:
            return None
        storage = str(parameter.StorageType)
        value = None
        if parameter.HasValue:
            if storage == "String": value = parameter.AsString()
            elif storage == "Integer": value = int(parameter.AsInteger())
            elif storage == "Double": value = float(parameter.AsDouble())
            elif storage == "ElementId": value = self.eid(parameter.AsElementId())
            else: raise ProbeRefused("Unsupported parameter storage: " + storage)
        return {"id": self.eid(parameter.Id), "name": str(parameter.Definition.Name),
                "guid": str(parameter.GUID) if parameter.IsShared else None,
                "specTypeId": str(parameter.Definition.GetDataType().TypeId),
                "storageType": storage, "hasValue": bool(parameter.HasValue), "value": value}

    def builtin(self, element, name):
        return self.param(element.get_Parameter(getattr(self.DB.BuiltInParameter, name)))

    def phase(self, room):
        p = room.get_Parameter(self.DB.BuiltInParameter.ROOM_PHASE_ID)
        if p is None or str(p.StorageType) != "ElementId":
            raise ProbeRefused("ROOM_PHASE_ID is absent or not ElementId")
        phase = self.doc.GetElement(p.AsElementId())
        if phase is None or not isinstance(phase, self.DB.Phase):
            raise ProbeRefused("Unresolved Room phase")
        return self.ref(phase)

    def option(self, element):
        option = element.DesignOption
        return {"kind": "main-model"} if option is None else {"kind": "design-option", "ref": self.ref(option)}

    def lifecycle(self, element):
        if not element.HasPhases():
            return {"hasPhases": False, "created": None, "demolished": None,
                    "source": "Element.HasPhases; lifecycle not applicable"}
        return {"hasPhases": True, "created": self.resolve(element.CreatedPhaseId, element.Document),
                "demolished": self.resolve(element.DemolishedPhaseId, element.Document),
                "source": "Element.CreatedPhaseId/DemolishedPhaseId"}

    def filter_parameter(self, room, selector):
        if selector["kind"] == "guid":
            from System import Guid
            return self.param(room.get_Parameter(Guid(selector["key"])))
        candidates = [p for p in room.Parameters if self.eid(p.Id) == selector["key"]]
        if len(candidates) > 1:
            raise ProbeRefused("Non-unique parameter id")
        return self.param(candidates[0]) if candidates else None

    def room_rows(self, selector=None):
        collector = self.DB.FilteredElementCollector(self.doc).OfCategory(self.DB.BuiltInCategory.OST_Rooms).WhereElementIsNotElementType()
        try:
            rows = []
            for room in collector:
                rows.append({"ref": self.ref(room), "phase": self.phase(room), "number": str(room.Number),
                             "name": self.builtin(room, "ROOM_NAME")["value"],
                             "filterParameter": self.filter_parameter(room, selector) if selector else None})
            return rows
        finally:
            collector.Dispose()

    def inventory(self, config):
        from System import Int64
        sample = self.doc.GetElement(self.DB.ElementId(Int64.Parse(config["sample_element_id"])))
        if sample is None or self.eid(sample.Category.Id) != str(int(self.DB.BuiltInCategory.OST_Rooms)):
            raise ProbeRefused("Sample element is not a root Room")
        return {"phases": [{"ref": self.ref(p), "name": str(p.Name)} for p in self.doc.Phases],
                "rooms": self.room_rows(), "sample": self.ref(sample),
                "sampleParameters": sorted([self.param(p) for p in sample.Parameters], key=lambda p: int(p["id"]))}

    def matrix(self, transform):
        x, y, z, o = (self.xyz(v) for v in (transform.BasisX, transform.BasisY, transform.BasisZ, transform.Origin))
        return [x[0], y[0], z[0], o[0], x[1], y[1], z[1], o[1], x[2], y[2], z[2], o[2], 0, 0, 0, 1]

    def link_inventory(self):
        collector = self.DB.FilteredElementCollector(self.doc).OfClass(self.DB.RevitLinkInstance)
        result = []
        try:
            for link in collector:
                link_type = self.doc.GetElement(link.GetTypeId())
                linked = link.GetLinkDocument()
                record = {"ref": self.ref(link), "instancePath": [self.ref(link)], "type": self.ref(link_type),
                          "loaded": linked is not None, "option": self.option(link),
                          "transform": rr("RevitLinkInstance.GetTransform; linked-internal-ft to root-internal-ft",
                                          lambda: self.matrix(link.GetTransform())),
                          "roomBoundingInstance": rr("WALL_ATTR_ROOM_BOUNDING on instance", lambda: self.builtin(link, "WALL_ATTR_ROOM_BOUNDING")),
                          "roomBoundingType": rr("WALL_ATTR_ROOM_BOUNDING on type", lambda: self.builtin(link_type, "WALL_ATTR_ROOM_BOUNDING")),
                          "nestedGeometry": unavailable("D1 scope", "Nested link geometry not traversed", "unsupported")}
                if linked is None:
                    record["phaseMap"] = unavailable("RevitLinkType.GetPhaseMap", "Link is unloaded")
                else:
                    record["linkedDocument"] = {"documentKey": str(linked.ProjectInformation.UniqueId), "isModified": bool(linked.IsModified)}
                    record["phaseMap"] = rr("RevitLinkType.GetPhaseMap; host phase -> linked phase",
                        lambda: [{"host": self.resolve(pair.Key), "linked": self.resolve(pair.Value, linked)} for pair in link_type.GetPhaseMap()])
                result.append(record)
            return result
        finally:
            collector.Dispose()

    def generator(self, segment):
        el = self.doc.GetElement(segment.ElementId)
        record = {"elementId": self.eid(segment.ElementId), "linkElementId": self.eid(segment.LinkElementId)}
        if el is None:
            return dict(record, status="unresolved", reason="Free or unavailable boundary generator")
        record.update(status="ok", ref=self.ref(el), categoryId=self.eid(el.Category.Id) if el.Category else None,
                      option=self.option(el), lifecycle=self.lifecycle(el))
        if isinstance(el, self.DB.RevitLinkInstance):
            linked = el.GetLinkDocument()
            record.update(status="unsupported", reason="Linked boundary requires separate linked geometry validation",
                          linkedRef=self.resolve(segment.LinkElementId, linked) if linked is not None else None)
        elif el.Category and el.Category.Id == self.DB.ElementId(self.DB.BuiltInCategory.OST_RoomSeparationLines):
            record["classification"] = "semantic-room-separator-not-physical-wall"
        else:
            record["classification"] = "wall" if isinstance(el, self.DB.Wall) else "other"
            record["roomBounding"] = rr("WALL_ATTR_ROOM_BOUNDING", lambda: self.builtin(el, "WALL_ATTR_ROOM_BOUNDING"))
        return record

    def external_references(self):
        # Include CAD/other references and uninstanced types; an empty RVT-instance
        # collector is not evidence that all external geometry is available.
        records = []
        for eid in self.DB.ExternalFileUtils.GetAllExternalFileReferences(self.doc):
            reference = self.DB.ExternalFileUtils.GetExternalFileReference(self.doc, eid)
            try:
                records.append({"ref": self.resolve(eid), "elementId": self.eid(eid),
                                "referenceType": str(reference.ExternalFileReferenceType),
                                "linkedFileStatus": str(reference.GetLinkedFileStatus()),
                                "geometryRelevance": "not assessed"})
            finally:
                reference.Dispose()
        return records

    def curve(self, curve):
        record = {"nativeType": str(curve.GetType().FullName), "isBound": bool(curve.IsBound)}
        if not curve.IsBound:
            return dict(record, status="unsupported", reason="Unbounded curve")
        record.update(parameterRange=[float(curve.GetEndParameter(i)) for i in (0, 1)],
                      start=self.xyz(curve.GetEndPoint(0)), end=self.xyz(curve.GetEndPoint(1)), lengthFt=float(curve.Length))
        if isinstance(curve, self.DB.Line):
            record.update(status="ok", kind="Line")
        elif isinstance(curve, self.DB.Arc):
            record.update(status="ok", kind="Arc", center=self.xyz(curve.Center), radiusFt=float(curve.Radius),
                          normal=self.xyz(curve.Normal), xDirection=self.xyz(curve.XDirection), yDirection=self.xyz(curve.YDirection))
        else:
            record.update(status="unsupported", reason="Native curve preserved by type; D1 has no complete serializer")
        return record

    def boundaries(self, room):
        options = self.DB.SpatialElementBoundaryOptions()
        options.SpatialElementBoundaryLocation = self.DB.SpatialElementBoundaryLocation.Finish
        options.StoreFreeBoundaryFaces = True
        try:
            loops = room.GetBoundarySegments(options)
            if loops is None:
                return {"status": "unavailable", "reason": "No boundary loops; not enclosed or unplaced"}
            result = []
            for loop in loops:
                output = []
                for segment in loop:
                    curve = segment.GetCurve()
                    try:
                        output.append({"curve": self.curve(curve), "generator": self.generator(segment)})
                    finally:
                        curve.Dispose()
                        segment.Dispose()
                result.append(output)
            return {"status": "ok", "source": "Room.GetBoundarySegments", "location": "Finish",
                    "storeFreeBoundaryFaces": True, "loopsInApiOrder": result,
                    "sectionAt1_2m": False, "outerHoleClassification": "not inferred from API order"}
        finally:
            options.Dispose()

    def north(self):
        location = self.doc.ActiveProjectLocation
        position = location.GetProjectPosition(self.DB.XYZ.Zero)
        try:
            return {"projectLocation": self.ref(location), "source": "ProjectLocation.GetProjectPosition(XYZ.Zero)",
                    "angleFromTrueNorthRadians": float(position.Angle), "eastWestFt": float(position.EastWest),
                    "northSouthFt": float(position.NorthSouth), "elevationFt": float(position.Elevation),
                    "appliedToInternalGeometry": False}
        finally:
            position.Dispose()

    def capture(self, config):
        rows = self.room_rows(config["parameter"])
        row, counts = select_room(rows, config["phase_uid"], config["value"], config["selected_room_uid"])
        room = self.doc.GetElement(row["ref"]["uniqueId"])
        if room is None:
            raise ProbeRefused("Room disappeared")
        if self.option(room)["kind"] != "main-model":
            raise ProbeRefused("D1 captures Main Model only; design option is unsupported")
        level = self.doc.GetElement(room.LevelId)
        location = room.Location
        location_record = unavailable("Room.Location", "Room has no LocationPoint")
        if isinstance(location, self.DB.LocationPoint):
            point = location.Point
            location_record = {"status": "ok", "source": "Room.Location/LocationPoint.Point", "xyzFt": self.xyz(point),
                               "isPointInRoom": bool(room.IsPointInRoom(point)), "isDaylightCalculationPoint": False}
        boundaries = self.boundaries(room)
        links = self.link_inventory()
        external = rr("ExternalFileUtils.GetAllExternalFileReferences/GetExternalFileReference", self.external_references)
        diagnostics = []
        if external["status"] != "ok": diagnostics.append("EXTERNAL_REFERENCE_INVENTORY_FAILED")
        elif any(item["linkedFileStatus"] != "Loaded" for item in external["value"]):
            diagnostics.append("EXTERNAL_REFERENCES_NOT_LOADED: geometry relevance unresolved")
        if any(not link["loaded"] for link in links): diagnostics.append("UNLOADED_LINKS: relevance to geometry/shading is unresolved")
        if any(link["phaseMap"]["status"] != "ok" for link in links): diagnostics.append("LINK_PHASE_MAP_INCOMPLETE")
        if boundaries["status"] != "ok": diagnostics.append("ROOM_BOUNDARIES_UNAVAILABLE")
        else:
            for loop in boundaries["loopsInApiOrder"]:
                for segment in loop:
                    if segment["curve"]["status"] != "ok": diagnostics.append("UNSUPPORTED_NATIVE_CURVE")
                    if segment["generator"]["status"] != "ok": diagnostics.append("BOUNDARY_GENERATOR_UNRESOLVED_OR_LINKED")
        if location_record["status"] != "ok" or room.Area <= 0: diagnostics.append("ROOM_UNPLACED_OR_NONPOSITIVE_AREA")
        north = rr("ProjectLocation.GetProjectPosition", self.north)
        if north["status"] != "ok": diagnostics.append("NORTH_UNAVAILABLE")
        return {"units": {"frame": "revit-internal-feet", "length": "ft", "area": "ft2", "volume": "ft3", "metresPerFoot": 0.3048,
                          "matrixConvention": "row-major-4x4-column-vector", "rootTransform": [1,0,0,0,0,1,0,0,0,0,1,0,0,0,0,1]},
                "scope": {"kind": "one-root-room", "selected": row["ref"], "phase": row["phase"], "filter": config["parameter"],
                          "value": config["value"], "counts": counts, "linksInventoriedRegardlessOfRoomFilter": True},
                "room": {**row, "versionGuid": str(room.VersionGuid), "option": self.option(room), "lifecycle": self.lifecycle(room),
                         "location": location_record, "level": self.ref(level),
                         "levelProjectElevationFt": float(level.ProjectElevation),
                         "levelComputationHeight": self.builtin(level, "LEVEL_ROOM_COMPUTATION_HEIGHT"),
                         "constraints": {key: self.builtin(room, key) for key in ("ROOM_UPPER_LEVEL", "ROOM_UPPER_OFFSET", "ROOM_LOWER_OFFSET")},
                         "areaFt2": float(room.Area), "perimeterFt": float(room.Perimeter), "volumeFt3": float(room.Volume),
                         "volumeMeaning": "Room.Volume may be zero when volume computation is disabled; not a verified 3D volume"},
                "boundaries": boundaries, "north": north, "links": links, "externalReferences": external,
                "diagnostics": sorted(set(diagnostics)), "geometryAccepted": False, "normativeAccepted": False,
                "aperturesAndShading": "not captured by D1"}


def run_d1(config, enabled, nonce, host_factory=D1Host):
    result = {"schema": D1_SCHEMA, "version": D1_VERSION, "sourceBundleSha256": BUNDLE_SHA256,
              "runId": str(uuid.uuid4()), "runNonce": str(nonce), "utc": datetime.datetime.now(datetime.timezone.utc).isoformat(),
              "status": "ERROR", "modelAccepted": False, "geometryAccepted": False, "normativeAccepted": False, "modelWriteRequested": False}
    host, before = None, None
    try:
        target = validate_d1(config)
        if type(enabled) is not bool: raise ProbeRefused("Enabled must be a Boolean")
        if not enabled:
            result.update(status="CANCELLED", reason="Disabled before accessing Revit")
            return result
        host = host_factory()
        identity = host.identity()
        if canonical_path(identity["path"], ".rvt") != target: raise ProbeRefused("Active document is not the explicitly selected test copy")
        if identity["revitVersion"] != config["expected_revit_version"] or identity["revitBuild"] != config["expected_revit_build"]:
            raise ProbeRefused("Unexpected Revit version/build")
        before = host.snapshot()
        result["before"] = before
        if any(before[key] for key in ("isModified", "isModifiable", "isWorkshared", "isLinked", "isFamilyDocument", "isModelInCloud")):
            raise ProbeRefused("D1 requires clean saved standalone root document")
        if before["sha256"].lower() != config["expected_sha256"].lower(): raise ProbeRefused("Test RVT hash differs from approved baseline")
        result["environment"] = host.environment()
        payload = host.inventory(config) if config["mode"] == "inventory" else host.capture(config)
        result.update(status="INVENTORY_OK" if config["mode"] == "inventory" else "CAPTURED_DIAGNOSTIC", payload=payload)
        result["payloadSha256"] = hashlib.sha256(json.dumps(payload, sort_keys=True, ensure_ascii=False, allow_nan=False, separators=(",", ":")).encode("utf-8")).hexdigest()
    except ProbeRefused as exc:
        result.update(status="REFUSED", reason=str(exc))
    except Exception as exc:
        result.update(status="ERROR", reason=type(exc).__name__ + ": " + str(exc))
    finally:
        if host is not None and before is not None:
            try:
                result["after"] = host.snapshot()
                result["documentUnchanged"] = before == result["after"]
                if not result["documentUnchanged"]: result.update(status="ERROR", reason="Document/file changed during D1")
            except Exception as exc:
                result.update(status="ERROR", documentUnchanged=False, reason="Post-check failed: " + str(exc))
    return result


def d1_entry(inputs):
    if len(inputs) != 3: raise ProbeRefused("Expected config path, enabled and run number")
    path = inputs[0]
    canonical_path(path, ".json")
    if os.path.getsize(path) > 65536: raise ProbeRefused("Configuration exceeds 64 KiB")
    with open(path, "r", encoding="utf-8-sig") as stream: config = json.load(stream)
    validate_d1(config)
    result = run_d1(config, inputs[1], inputs[2])
    output = config["evidence_jsonl"]
    if os.path.exists(output):
        if os.path.getsize(output) > 25 * 1024 * 1024: raise ProbeRefused("D1 evidence log exceeds 25 MiB")
        with open(output, "r", encoding="utf-8") as stream:
            for line in stream:
                if line.strip() and json.loads(line).get("schema") != D1_SCHEMA: raise ProbeRefused("Existing output is not a D1 evidence log")
    serialized = json.dumps(result, ensure_ascii=False, sort_keys=True, allow_nan=False)
    with open(output, "a", encoding="utf-8", newline="\n") as stream: stream.write(serialized + "\n")
    return json.dumps({key: value for key, value in result.items() if key != "payload"}, ensure_ascii=False, indent=2)


"""Read-only inventory of candidate calculator inputs and plan annotation resources.

Uses D0/D1 guards. Parameter values remain candidates until their meanings,
applicability and provenance are checked; no coefficient defaults or model writes.
"""

class InputHost(D1Host):
    def params(self, element):
        return sorted([self.param(p) for p in element.Parameters], key=lambda p: p["id"])

    def descriptor(self, element):
        if element is None:
            return None
        try:
            name = str(element.Name)
        except (AttributeError, TypeError):
            p = element.get_Parameter(self.DB.BuiltInParameter.SYMBOL_NAME_PARAM)
            name = p.AsString() if p and p.HasValue else ""
        return dict(self.ref(element), name=str(name), category=self.eid(element.Category.Id) if element.Category else None)

    def outline(self, room):
        options = self.DB.SpatialElementBoundaryOptions()
        options.SpatialElementBoundaryLocation = self.DB.SpatialElementBoundaryLocation.Finish
        try:
            boundaries = room.GetBoundarySegments(options)
            if boundaries is None:
                return []
            return [[{"kind": str(s.GetCurve().GetType().Name),
                      "lengthFt": float(s.GetCurve().Length),
                      "startFt": self.xyz(s.GetCurve().GetEndPoint(0)),
                      "endFt": self.xyz(s.GetCurve().GetEndPoint(1)),
                      "generatorId": self.eid(s.ElementId)} for s in loop] for loop in boundaries]
        finally:
            options.Dispose()

    def input_inventory(self, config):
        room = self.doc.GetElement(config["selected_room_uid"])
        phase = self.doc.GetElement(config["phase_uid"])
        if room is None or not isinstance(room, self.DB.Architecture.Room):
            raise ProbeRefused("Selected UID is not a Room")
        if self.phase(room)["uniqueId"] != config["phase_uid"] or room.DesignOption is not None:
            raise ProbeRefused("Room phase/option mismatch")
        payload = {"room": self.descriptor(room), "roomParameters": self.params(room),
                   "roomOutline": self.outline(room), "projectParameters": self.params(self.doc.ProjectInformation),
                   "phase": self.descriptor(phase), "units": "internal feet; raw parameters retain specTypeId",
                   "windows": [], "rooms": [], "planResources": {}}
        location = self.doc.ActiveProjectLocation
        position = location.GetProjectPosition(self.DB.XYZ.Zero)
        payload["north"] = {"angleFromTrueNorthRadians": float(position.Angle), "projectLocation": self.descriptor(location)}
        for w in self.DB.FilteredElementCollector(self.doc).OfCategory(self.DB.BuiltInCategory.OST_Windows).WhereElementIsNotElementType():
            if not isinstance(w, self.DB.FamilyInstance):
                continue
            f = rr("get_FromRoom(phase)", lambda: self.descriptor(w.get_FromRoom(phase)))
            t = rr("get_ToRoom(phase)", lambda: self.descriptor(w.get_ToRoom(phase)))
            linked_to_room = any(x.get("value") and x["value"]["uniqueId"] == room.UniqueId for x in (f,t))
            row = {"ref": self.descriptor(w), "fromRoom": f, "toRoom": t,
                   "host": self.descriptor(w.Host), "type": self.descriptor(w.Symbol),
                   "lifecycle": self.lifecycle(w), "option": self.option(w)}
            if linked_to_room:
                row.update(parameters=self.params(w), typeParameters=self.params(w.Symbol),
                           location=rr("Location.Point", lambda: self.xyz(w.Location.Point)),
                           facing=self.xyz(w.FacingOrientation), hand=self.xyz(w.HandOrientation))
                if isinstance(w.Host, self.DB.Wall):
                    row["hostParameters"] = self.params(w.Host)
                    row["hostKind"] = str(w.Host.WallType.Kind)
                    row["hostCurve"] = str(w.Host.Location.Curve.GetType().Name)
            payload["windows"].append(row)
        for r in self.DB.FilteredElementCollector(self.doc).OfCategory(self.DB.BuiltInCategory.OST_Rooms).WhereElementIsNotElementType():
            if self.phase(r)["uniqueId"] != config["phase_uid"] or r.DesignOption is not None:
                continue
            loops = self.outline(r)
            payload["rooms"].append(dict(self.descriptor(r), number=str(r.Number), areaFt2=float(r.Area),
                                        levelId=self.eid(r.LevelId), outline=loops))
        for key, cls in (("plans",self.DB.ViewPlan), ("colorSchemes",self.DB.ColorFillScheme),
                         ("textTypes",self.DB.TextNoteType), ("viewTypes",self.DB.ViewFamilyType)):
            payload["planResources"][key] = [dict(self.descriptor(e),
                detail=rr("plan metadata",lambda: {"viewType": str(e.ViewType), "template": bool(e.IsTemplate), "level": self.descriptor(e.GenLevel)}))
                if key == "plans" else self.descriptor(e) for e in self.DB.FilteredElementCollector(self.doc).OfClass(cls)]
        payload["planResources"]["roomTagTypes"] = [dict(self.descriptor(e), family=str(e.FamilyName),parameters=self.params(e))
            for e in self.DB.FilteredElementCollector(self.doc).OfCategory(self.DB.BuiltInCategory.OST_RoomTags).WhereElementIsElementType()]
        return payload


def input_entry(inputs):
    if len(inputs) != 3:
        raise ProbeRefused("Expected config, enabled, nonce")
    canonical_path(inputs[0], ".json")
    if os.path.getsize(inputs[0]) > 65536:
        raise ProbeRefused("Configuration too large")
    with open(inputs[0], encoding="utf-8-sig") as f:
        config = json.load(f)
    required = {"schema","documentGuard","selected_room_uid","phase_uid","evidence_jsonl"}
    if set(config) != required or config["schema"] != "keo-dynamo-inputs-config/v1":
        raise ProbeRefused("Unexpected configuration")
    canonical_path(config["evidence_jsonl"], ".jsonl")
    guard = run_probe(config["documentGuard"], inputs[1], inputs[2], InputHost)
    result = {"schema":"keo-dynamo-inputs-evidence/v1", "status":guard["status"],"guard":guard,
              "bundleSha256":BUNDLE_SHA256,"geometryAccepted":False,"normativeAccepted":False,
              "runNonce":str(inputs[2]),"modelWriteRequested":False}
    if guard["status"] == "READ_ONLY_OK":
        host = InputHost()
        try:
            if host.snapshot() != guard["after"]:
                raise ProbeRefused("Changed document before inventory")
            result["payload"] = host.input_inventory(config)
            result["payloadSha256"] = hashlib.sha256(json.dumps(result["payload"],ensure_ascii=False,sort_keys=True).encode("utf-8")).hexdigest()
            result["status"] = "INPUT_CANDIDATES_CAPTURED"
        except Exception as exc:
            result.update(status="ERROR",reason=type(exc).__name__+": "+str(exc))
        finally:
            result["after"] = host.snapshot()
            result["documentUnchanged"] = result["after"] == guard["before"]
            if not result["documentUnchanged"]:
                result.update(status="ERROR",reason="Document changed during inventory")
    output = config["evidence_jsonl"]
    if os.path.exists(output):
        if os.path.getsize(output)>10*1024*1024:
            raise ProbeRefused("Evidence log too large")
        with open(output,encoding="utf-8") as f:
            if any(json.loads(line).get("schema")!=result["schema"] for line in f if line.strip()):
                raise ProbeRefused("Unexpected existing evidence")
    with open(output,"a",encoding="utf-8",newline="\n") as f:
        f.write(json.dumps(result,ensure_ascii=False,sort_keys=True)+"\n")
    return json.dumps({k:v for k,v in result.items() if k not in ("payload","guard","after")},ensure_ascii=False,indent=2)


"""Diagnostic PENDING plan only. Never writes a numeric KEO or PASS/FAIL.

IN: explicit local config, Boolean enabled, run nonce. Bundle with D0/D1.
Preview, rollback rehearsal and apply are separate explicit actions. No RVT save.
"""
STATUS_GUID = "17be729c-280f-493e-bad6-e4e2ec7b88c1"
STATUS_NAME = "KEO_Статус"
SCHEME_NAME = "КЕО — диагностический статус"


def pending_plan(config, evidence):
    if config.get("action") not in ("preview", "rollback", "apply"):
        raise ProbeRefused("Unknown action")
    if evidence.get("status") != "INPUT_CANDIDATES_CAPTURED" or not evidence.get("documentUnchanged"):
        raise ProbeRefused("Successful unchanged Room capture required")
    room = evidence["payload"]["room"]
    if room["uniqueId"] != config["room_uid"]:
        raise ProbeRefused("Room identity mismatch")
    if not config.get("reason") or len(config["reason"]) > 240:
        raise ProbeRefused("Explicit short pending reason required")
    return {"schema":"keo-pending-plan/v1", "room":room, "status":"PENDING", "color":[180,180,180],
            "calculatedKeo":None,"normativeKeo":None,"reason":config["reason"],
            "viewName":config["view_name"],"sourceViewUid":config["source_view_uid"],
            "tagTypeUid":config["tag_type_uid"],"textTypeUid":config["text_type_uid"],
            "parameter":{"name":STATUS_NAME,"guid":STATUS_GUID,"storage":"String"},
            "sourcePayloadSha256":evidence["payloadSha256"],
            "changes":["Bind one new Room status parameter", "Set selected Room status to Уточнить",
                       "Create one independent plan", "Create one gray Room color scheme",
                       "Place existing native RoomTag and diagnostic TextNote"],
            "limitations":["No numerical calculation", "No KEO family label yet", "No RVT save", "No automatic stale monitor"]}


class PendingHost(D1Host):
    def note_text(self, plan):
        return "КЕО: —   Норма: —\nУТОЧНИТЬ\n"+plan["reason"]

    def capture_still_matches(self, config, evidence):
        probe=InputHost()
        payload=probe.input_inventory({"selected_room_uid":config["room_uid"],
                                       "phase_uid":evidence["payload"]["phase"]["uniqueId"]})
        digest=hashlib.sha256(json.dumps(payload,sort_keys=True,ensure_ascii=False).encode("utf-8")).hexdigest()
        if digest!=evidence["payloadSha256"]:
            raise ProbeRefused("Fresh input payload differs from reviewed capture")

    def prepare(self, config, evidence):
        from System import Guid
        d, DB = self.doc, self.DB
        current = self.snapshot()
        if current != evidence["after"]:
            diff = {k: [evidence["after"].get(k),v] for k,v in current.items() if evidence["after"].get(k)!=v}
            if set(diff)!={"versionGuid"}:
                raise ProbeRefused("Capture is stale: "+json.dumps(diff,ensure_ascii=False))
            # A rolled-back Revit transaction can change VersionGUID even when
            # IsModified is false. Re-read the entire captured input payload;
            # metadata alone never grants acceptance of stale geometry.
            self.capture_still_matches(config,evidence)
        room=d.GetElement(config["room_uid"])
        source=d.GetElement(config["source_view_uid"])
        tag=d.GetElement(config["tag_type_uid"])
        text=d.GetElement(config["text_type_uid"])
        if not isinstance(room,DB.Architecture.Room) or room.Area<=0 or room.Location is None:
            raise ProbeRefused("Placed enclosed Room required")
        if not isinstance(source,DB.ViewPlan) or source.IsTemplate or source.GenLevel.Id!=room.LevelId:
            raise ProbeRefused("Source plan must be on Room level")
        if not isinstance(tag,DB.FamilySymbol) or tag.Category.Id!=DB.ElementId(DB.BuiltInCategory.OST_RoomTags):
            raise ProbeRefused("Existing RoomTag type required")
        if not isinstance(text,DB.TextNoteType):
            raise ProbeRefused("Existing text type required")
        if DB.SharedParameterElement.Lookup(d,Guid(STATUS_GUID)) is not None:
            raise ProbeRefused("Status parameter already exists; explicit update workflow required")
        it=d.ParameterBindings.ForwardIterator()
        while it.MoveNext():
            if str(it.Key.Name)==STATUS_NAME:
                raise ProbeRefused("Existing status name conflicts; no overwrite")
        if any(str(v.Name)==config["view_name"] for v in DB.FilteredElementCollector(d).OfClass(DB.View)):
            raise ProbeRefused("Target plan already exists; no duplicate")
        schemes=[s for s in DB.FilteredElementCollector(d).OfClass(DB.ColorFillScheme)
                 if s.CategoryId==DB.ElementId(DB.BuiltInCategory.OST_Rooms)]
        if not schemes or any(str(s.Name)==SCHEME_NAME for s in schemes):
            raise ProbeRefused("Missing source scheme or target scheme conflict")
        return room,source,tag,text,schemes[0]

    def write_pending(self, config, evidence, plan):
        from System import Guid
        from System.Collections.Generic import List
        room,source,tag_type,text_type,scheme_source=self.prepare(config,evidence)
        baseline=self.snapshot()
        d,DB,app=self.doc,self.DB,self.ui.Application
        shared=config["shared_parameters_path"]
        canonical_path(shared,".txt")
        if not os.path.isfile(shared):
            raise ProbeRefused("Explicit shared parameter definition file required")
        old_shared=app.SharedParametersFilename
        try:
            app.SharedParametersFilename=shared
            definition_file=app.OpenSharedParameterFile()
            definition=definition_file.Groups.get_Item("KEO").Definitions.get_Item(STATUS_NAME)
            if str(definition.GUID).lower()!=STATUS_GUID or definition.GetDataType()!=DB.SpecTypeId.String.Text:
                raise ProbeRefused("Wrong status definition")
        finally:
            app.SharedParametersFilename=old_shared
        group=DB.TransactionGroup(d,"КЕО — диагностический план")
        changed={}
        try:
            group.Start()
            tr=DB.Transaction(d,"КЕО — статус и отдельный план")
            try:
                tr.Start()
                categories=app.Create.NewCategorySet()
                categories.Insert(DB.Category.GetCategory(d,DB.BuiltInCategory.OST_Rooms))
                if not d.ParameterBindings.Insert(definition,app.Create.NewInstanceBinding(categories),DB.GroupTypeId.Data):
                    raise ProbeRefused("Parameter binding failed")
                d.Regenerate()
                parameter=room.get_Parameter(Guid(STATUS_GUID))
                if parameter is None or parameter.IsReadOnly or not parameter.Set("Уточнить"):
                    raise ProbeRefused("Cannot set new Room status")
                view=d.GetElement(source.Duplicate(DB.ViewDuplicateOption.Duplicate))
                view.Name=config["view_name"]
                view.ViewTemplateId=DB.ElementId.InvalidElementId
                view.Scale=100
                view.CropBoxActive=False
                view.CropBoxVisible=False
                phase=room.get_Parameter(DB.BuiltInParameter.ROOM_PHASE_ID).AsElementId()
                view.get_Parameter(DB.BuiltInParameter.VIEW_PHASE).Set(phase)
                cat=DB.ElementId(DB.BuiltInCategory.OST_Rooms)
                view.SetCategoryHidden(cat,False)
                view.SetCategoryHidden(DB.ElementId(DB.BuiltInCategory.OST_RoomTags),False)
                scheme=d.GetElement(scheme_source.Duplicate(SCHEME_NAME))
                scheme.ParameterDefinition=parameter.Id
                scheme.Title="КЕО: требуется уточнение"
                scheme.IsLinkedFilesIncluded=False
                solid=next(e for e in DB.FilteredElementCollector(d).OfClass(DB.FillPatternElement) if e.GetFillPattern().IsSolidFill)
                entries=List[DB.ColorFillSchemeEntry]()
                entry=DB.ColorFillSchemeEntry(DB.StorageType.String)
                entry.SetStringValue("Уточнить")
                entry.Color=DB.Color(180,180,180)
                entry.FillPatternId=solid.Id
                entry.IsVisible=True
                entries.Add(entry)
                scheme.SetEntries(entries)
                view.SetColorFillSchemeId(cat,scheme.Id)
                if not tag_type.IsActive:
                    tag_type.Activate()
                p=room.Location.Point
                mark=d.Create.NewRoomTag(DB.LinkElementId(room.Id),DB.UV(p.X,p.Y),view.Id)
                mark.ChangeTypeId(tag_type.Id)
                note_text=self.note_text(plan)
                # Width is paper-space feet, unlike the model-space placement.
                note=DB.TextNote.Create(d,view.Id,DB.XYZ(p.X,p.Y-5,p.Z),0.16,note_text,text_type.Id)
                changed={"view":self.ref(view),"room":self.ref(room),"scheme":self.ref(scheme),
                         "roomTag":self.ref(mark),"diagnosticText":self.ref(note),"statusParameterId":self.eid(parameter.Id)}
                if tr.Commit()!=DB.TransactionStatus.Committed:
                    raise ProbeRefused("Transaction did not commit")
            finally:
                if tr.GetStatus()==DB.TransactionStatus.Started:
                    tr.RollBack()
                tr.Dispose()
            if config["action"]=="rollback":
                if group.RollBack()!=DB.TransactionStatus.RolledBack:
                    raise ProbeRefused("Group rollback failed")
                after=self.snapshot()
                if any(after[k]!=baseline[k] for k in baseline if k!="versionGuid"):
                    raise ProbeRefused("Rollback did not restore baseline state")
                self.capture_still_matches(config,evidence)
                return {"status":"ROLLBACK_VERIFIED","proposedElements":changed,
                        "inputPayloadUnchanged":True,"versionGuidChanged":after["versionGuid"]!=baseline["versionGuid"]}
            if group.Assimilate()!=DB.TransactionStatus.Committed:
                raise ProbeRefused("Group commit failed")
            return {"status":"PENDING_PLAN_APPLIED","elements":changed}
        finally:
            if group.GetStatus()==DB.TransactionStatus.Started:
                group.RollBack()
            group.Dispose()


def pending_entry(inputs):
    if len(inputs)!=3 or type(inputs[1]) is not bool:
        raise ProbeRefused("Expected config, Boolean, nonce")
    canonical_path(inputs[0],".json")
    with open(inputs[0],encoding="utf-8-sig") as f: config=json.load(f)
    if config.get("schema")!="keo-pending-config/v1": raise ProbeRefused("Wrong configuration")
    for field,ext in (("evidence_path",".json"),("evidence_jsonl",".jsonl"),("shared_parameters_path",".txt")):
        canonical_path(config[field],ext)
    result={"schema":"keo-pending-run/v1","status":"CANCELLED","nonce":str(inputs[2]),
            "bundleSha256":BUNDLE_SHA256,"numericKeoWritten":False,"rvtSaved":False}
    if inputs[1]:
        guard=run_probe(config["documentGuard"],True,inputs[2],PendingHost)
        if guard["status"]!="READ_ONLY_OK": raise ProbeRefused(guard.get("reason","Guard failed"))
        with open(config["evidence_path"],encoding="utf-8") as f: evidence=json.load(f)
        plan=pending_plan(config,evidence)
        digest=hashlib.sha256(json.dumps(plan,sort_keys=True,ensure_ascii=False).encode("utf-8")).hexdigest()
        host=PendingHost()
        host.prepare(config,evidence)
        result.update(status="PREVIEW_READY",plan=plan,planSha256=digest,before=host.snapshot())
        if config["action"]!="preview":
            if config.get("approved_plan_sha256")!=digest:
                raise ProbeRefused("Exact reviewed plan fingerprint required")
            result.update(host.write_pending(config,evidence,plan))
        result["after"]=host.snapshot()
        if result["after"]["sha256"]!=result["before"]["sha256"]:
            raise ProbeRefused("RVT file changed")
    with open(config["evidence_jsonl"],"a",encoding="utf-8",newline="\n") as f:
        f.write(json.dumps(result,ensure_ascii=False,sort_keys=True)+"\n")
    return json.dumps({k:v for k,v in result.items() if k not in ("before","after")},ensure_ascii=False,indent=2)


if "IN" in globals():
    try:
        OUT=pending_entry(IN)
    except Exception as exc:
        OUT=json.dumps({"status":"ERROR","reason":type(exc).__name__+": "+str(exc),"rvtSaved":False},ensure_ascii=False,indent=2)
# ----------------------------------------
d5_summary = Watch(d5_pending_plan)  # graph output
