# Dynamo graph KEO_D3_CoreReplay.dyn "KEO D3 - Synthetic core replay" (Dynamo 4.2.1.5887)
# author: keo-calc
# Read-only synthetic Python -> original JS core. No real Room KEO or model writes.

config_json_path_local_only = StringInput("")  # graph input
read_test_rvt_false_cancel = BoolSelector(false)  # graph input
run_number_change_to_repeat = IntegerSlider(0, range=0..1000 step 1)  # graph input
d3_synthetic_core_replay = Python(IN[0]=config_json_path_local_only, IN[1]=read_test_rvt_false_cancel, IN[2]=run_number_change_to_repeat)  # PythonNet3
# ---------- d3_synthetic_core_replay.python (366 lines) ----------
BUNDLE_SHA256 = "14d7513cd042f43c731ff1d4d3b97e0366aedc118312920bbb74fabd9d4a790f"
"""D0: read-only environment probe for Dynamo PythonNet3. No model writes.

IN: absolute config JSON path, enabled Boolean, run nonce (change to rerun).
OUT: JSON evidence. Configuration and runtime evidence are private local files.
"""
import datetime
import json
import ntpath
import os
import re
import sys
import uuid

PROBE_VERSION = "0.1.0"
SOURCE_SHA256 = globals().get("SOURCE_SHA256", "unbundled")


class ProbeRefused(Exception):
    pass


def canonical_path(value, extension):
    if not isinstance(value, str) or not ntpath.isabs(value):
        raise ProbeRefused("An absolute local path is required")
    path = ntpath.normpath(value)
    if path.startswith("\\\\") or ntpath.splitext(path)[1].lower() != extension:
        raise ProbeRefused("Wrong file extension or non-local path")
    return ntpath.normcase(path)


def validate_config(config):
    required = {"schema", "expected_rvt_path", "expected_sha256", "expected_revit_version", "expected_revit_build"}
    optional = {"evidence_jsonl"}
    if not isinstance(config, dict) or set(config) - required - optional or not required <= set(config):
        raise ProbeRefused("Unexpected or missing configuration fields")
    if config["schema"] != "keo-dynamo-d0-config/v1":
        raise ProbeRefused("Unsupported configuration schema")
    target = canonical_path(config["expected_rvt_path"], ".rvt")
    if not isinstance(config["expected_sha256"], str) or not re.fullmatch(r"[0-9a-fA-F]{64}", config["expected_sha256"]):
        raise ProbeRefused("An independently recorded RVT SHA-256 is required")
    for key in ("expected_revit_version", "expected_revit_build"):
        if not isinstance(config[key], str) or not config[key].strip():
            raise ProbeRefused("An explicit Revit version/build is required")
    if config.get("evidence_jsonl"):
        canonical_path(config["evidence_jsonl"], ".jsonl")
    return target


def run_probe(config, enabled, nonce, host_factory):
    result = {
        "schema": "keo-dynamo-d0-evidence/v1", "probeVersion": PROBE_VERSION,
        "sourceSha256": SOURCE_SHA256, "runId": str(uuid.uuid4()),
        "runNonce": str(nonce), "utc": datetime.datetime.now(datetime.timezone.utc).isoformat(),
        "status": "ERROR", "modelAccepted": False, "geometryAccepted": False,
        "normativeAccepted": False, "modelWriteRequested": False,
    }
    host = None
    before = None
    try:
        target = validate_config(config)
        if type(enabled) is not bool:
            raise ProbeRefused("Enabled must be a Boolean")
        if not enabled:
            result.update(status="CANCELLED", reason="Disabled before accessing Revit")
            return result
        host = host_factory()
        identity = host.identity()
        if canonical_path(identity["path"], ".rvt") != target:
            raise ProbeRefused("Active document does not match the explicitly selected test RVT")
        if identity["revitVersion"] != config["expected_revit_version"] or identity["revitBuild"] != config["expected_revit_build"]:
            raise ProbeRefused("Revit version/build mismatch")
        # Runtime metadata is diagnostic even if the document fails the guard.
        result["environment"] = host.environment()
        before = host.snapshot()
        result["before"] = before
        if any(before[key] for key in ("isModified", "isModifiable", "isWorkshared", "isLinked", "isFamilyDocument", "isModelInCloud")):
            raise ProbeRefused("Only unchanged saved standalone local root RVT is supported by D0")
        if before["sha256"].lower() != config["expected_sha256"].lower():
            raise ProbeRefused("RVT differs from the independently recorded SHA-256")
        result["document"] = identity
        result["roomCount"] = host.room_count()
        result["status"] = "READ_ONLY_OK"
    except ProbeRefused as exc:
        result.update(status="REFUSED", reason=str(exc))
    except Exception as exc:
        result.update(status="ERROR", reason=type(exc).__name__ + ": " + str(exc))
    finally:
        if host is not None and before is not None:
            try:
                after = host.snapshot()
                result["after"] = after
                result["documentUnchanged"] = before == after
                if before != after:
                    result.update(status="ERROR", reason="Document/file changed during probe")
            except Exception as exc:
                result.update(status="ERROR", documentUnchanged=False,
                              reason="Post-check failed: " + type(exc).__name__ + ": " + str(exc))
    return result


class RevitHost:
    def __init__(self):
        import clr
        clr.AddReference("RevitAPI")
        clr.AddReference("RevitServices")
        from RevitServices.Persistence import DocumentManager
        from Autodesk.Revit import DB
        self.DB = DB
        self.manager = DocumentManager.Instance
        self.doc = self.manager.CurrentDBDocument
        self.ui = self.manager.CurrentUIApplication
        if self.doc is None or self.ui is None or self.ui.ActiveUIDocument is None:
            raise ProbeRefused("No active Revit document")
        if not self.doc.Equals(self.ui.ActiveUIDocument.Document):
            raise ProbeRefused("Dynamo and Revit active documents differ")

    def identity(self):
        app = self.ui.Application
        return {"path": str(self.doc.PathName), "title": str(self.doc.Title),
                "revitVersion": str(app.VersionNumber), "revitBuild": str(app.VersionBuild)}

    def snapshot(self):
        from System import BitConverter
        from System.IO import FileStream, FileMode, FileAccess, FileShare
        from System.Security.Cryptography import SHA256
        if not self.doc.IsValidObject or not self.doc.Equals(self.manager.CurrentDBDocument) or not self.doc.Equals(self.ui.ActiveUIDocument.Document):
            raise ProbeRefused("Active document changed")
        path = str(self.doc.PathName)
        canonical_path(path, ".rvt")
        version = self.DB.Document.GetDocumentVersion(self.doc)
        try:
            result = {"path": path, "versionGuid": str(version.VersionGUID),
                      "numberOfSaves": int(version.NumberOfSaves)}
        finally:
            version.Dispose()
        for name in ("IsModified", "IsModifiable", "IsWorkshared", "IsLinked", "IsFamilyDocument", "IsModelInCloud"):
            result[name[0].lower() + name[1:]] = bool(getattr(self.doc, name))
        stream = FileStream(path, FileMode.Open, FileAccess.Read, FileShare.ReadWrite)
        hasher = SHA256.Create()
        try:
            result["fileLength"] = int(stream.Length)
            result["sha256"] = str(BitConverter.ToString(hasher.ComputeHash(stream))).replace("-", "").lower()
        finally:
            hasher.Dispose()
            stream.Dispose()
        return result

    def environment(self):
        import platform
        from System import AppDomain, Environment
        from System.Diagnostics import FileVersionInfo, Process
        names = {"DynamoCore", "DynamoRevitDS", "RevitAPI", "RevitServices", "Python.Runtime", "DSPythonNet3"}
        assemblies = []
        for assembly in AppDomain.CurrentDomain.GetAssemblies():
            name = str(assembly.GetName().Name)
            if name in names:
                info = FileVersionInfo.GetVersionInfo(assembly.Location)
                assemblies.append({"name": name, "assemblyVersion": str(assembly.GetName().Version),
                                   "fileVersion": str(info.FileVersion)})
        return {"python": sys.version, "pythonImplementation": platform.python_implementation(),
                "dotnet": str(Environment.Version), "processId": int(Process.GetCurrentProcess().Id),
                "assemblies": sorted(assemblies, key=lambda item: item["name"])}

    def room_count(self):
        collector = self.DB.FilteredElementCollector(self.doc).OfCategory(self.DB.BuiltInCategory.OST_Rooms).WhereElementIsNotElementType()
        try:
            return int(collector.GetElementCount())
        finally:
            collector.Dispose()


def dynamo_entry(inputs):
    if len(inputs) != 3:
        raise ProbeRefused("Expected configuration path, enabled Boolean and run nonce")
    path = inputs[0]
    canonical_path(path, ".json")
    if os.path.getsize(path) > 65536:
        raise ProbeRefused("Configuration exceeds 64 KiB")
    with open(path, "r", encoding="utf-8-sig") as stream:
        config = json.load(stream)
    result = run_probe(config, inputs[1], inputs[2], RevitHost)
    # Append only to an explicit local evidence log; never open the RVT for writing.
    # Invalid configuration cannot grant permission to write an output file.
    validate_config(config)
    if config.get("evidence_jsonl"):
        output = config["evidence_jsonl"]
        if os.path.exists(output):
            if os.path.getsize(output) > 10 * 1024 * 1024:
                raise ProbeRefused("Evidence log exceeds 10 MiB")
            with open(output, "r", encoding="utf-8") as stream:
                for line in stream:
                    if line.strip() and json.loads(line).get("schema") != result["schema"]:
                        raise ProbeRefused("Existing file is not a D0 evidence log")
        with open(output, "a", encoding="utf-8", newline="\n") as stream:
            stream.write(json.dumps(result, ensure_ascii=False, sort_keys=True) + "\n")
    return json.dumps(result, ensure_ascii=False, indent=2, sort_keys=True)



"""Local Python -> unchanged JS calculator. No Revit API, transactions or shell.

This client transports PREVIEW results only. It cannot approve BIM/norm evidence.
Use absolute paths to the installed Node executable and the packaged runner.
"""
import json
import math
import os
import subprocess
import tempfile
import time

SCHEMA = "keo-runner-preview/0.1"
INPUT_LIMIT = 2 * 1024 * 1024
OUTPUT_LIMIT = 16 * 1024 * 1024


def failure(code, detail):
    return {"schema": SCHEMA, "ok": False, "previewOnly": True,
            "status": "ERROR", "color": "gray", "previewImportJson": None,
            "errors": [{"code": code, "detail": detail}]}


def calculate(envelope, node_executable, runner_path, timeout_seconds=30,
              cancelled=None):
    """Cancellation callback is polled between waits (<=100 ms). No shell=True."""
    process = None
    try:
        if cancelled and cancelled():
            return failure("cancelled", "Отменено до запуска")
        if not math.isfinite(timeout_seconds) or timeout_seconds <= 0:
            return failure("invalid-timeout", "Нужен положительный тайм-аут")
        for value in (node_executable, runner_path):
            if not os.path.isabs(value) or not os.path.isfile(value):
                return failure("runtime-path", "Нужны абсолютные пути к Node и runner")
        payload = json.dumps(envelope, ensure_ascii=False, allow_nan=False).encode("utf-8")
        if len(payload) > INPUT_LIMIT:
            return failure("input-too-large", "Превышен размер входного JSON")
        env = dict(os.environ)
        env.pop("NODE_OPTIONS", None)
        env.pop("NODE_PATH", None)
        with tempfile.TemporaryFile() as stdout, tempfile.TemporaryFile() as stderr:
            process = subprocess.Popen(
                [node_executable, runner_path], stdin=subprocess.PIPE,
                stdout=stdout, stderr=stderr, cwd=os.path.dirname(runner_path),
                shell=False, env=env,
                creationflags=getattr(subprocess, "CREATE_NO_WINDOW", 0))
            deadline = time.monotonic() + timeout_seconds
            first = True
            while True:
                if cancelled and cancelled():
                    return failure("cancelled", "Расчёт отменён; результат не принят")
                remaining = deadline - time.monotonic()
                if remaining <= 0:
                    return failure("timeout", "Расчёт превысил тайм-аут")
                if max(os.fstat(stdout.fileno()).st_size, os.fstat(stderr.fileno()).st_size) > OUTPUT_LIMIT:
                    return failure("output-too-large", "Превышен размер ответа")
                try:
                    process.communicate(input=payload if first else None, timeout=min(.1, remaining))
                    break
                except subprocess.TimeoutExpired:
                    first = False
            stdout.seek(0)
            raw = stdout.read(OUTPUT_LIMIT + 1)
            if len(raw) > OUTPUT_LIMIT or os.fstat(stderr.fileno()).st_size > OUTPUT_LIMIT:
                return failure("output-too-large", "Превышен размер ответа")
            response = json.loads(raw.decode("utf-8"))
            if not isinstance(response, dict) or response.get("schema") != SCHEMA:
                return failure("invalid-response", "Неизвестный протокол ответа")
            if response.get("previewOnly") is not True or response.get("color") != "gray" or response.get("status") not in ("PENDING", "ERROR"):
                return failure("invalid-response", "Runner не имеет права подтверждать результат Room")
            if process.returncode != 0:
                return failure("runner-exit", "Runner завершился с кодом %s: %s" %
                               (process.returncode, response.get("errors", [])))
            if response.get("ok") is not True:
                return failure("invalid-response", "Runner не подтвердил вычисление")
            result = response.get("coreResult", {})
            value = result.get("res", {}).get("eFinal")
            if isinstance(value, bool) or not isinstance(value, (int, float)) or not math.isfinite(value):
                return failure("invalid-response", "Нет конечного значения КЕО")
            return response
    except (OSError, ValueError, TypeError) as error:
        return failure("client-error", str(error))
    finally:
        if process is not None:
            if process.poll() is None:
                process.kill()
            process.wait()


"""D3 synthetic exchange probe for the existing three-input Dynamo scaffold.

Bundled with d0_probe.py (guards) and client.py (process transport). It does not
extract Room inputs, accept evidence, write transactions or save the model.
"""
import hashlib


def run_d3(config, enabled, nonce, host_factory):
    required = {"schema", "documentGuard", "node_executable", "runner_path", "requests_path", "evidence_jsonl"}
    if not isinstance(config, dict) or set(config) != required or config["schema"] != "keo-dynamo-d3-config/v1":
        raise ProbeRefused("Unexpected D3 configuration")
    for key, ext in (("node_executable", ".exe"), ("runner_path", ".cjs"), ("requests_path", ".json"), ("evidence_jsonl", ".jsonl")):
        canonical_path(config[key], ext)
    guard = run_probe(config["documentGuard"], enabled, nonce, host_factory)
    result = {"schema": "keo-dynamo-d3-evidence/v1", "bundleSha256": globals().get("BUNDLE_SHA256", "unbundled"),
              "runNonce": str(nonce), "utc": datetime.datetime.now(datetime.timezone.utc).isoformat(),
              "syntheticOnly": True, "geometryAccepted": False, "normativeAccepted": False,
              "modelWriteRequested": False, "status": guard["status"], "guard": guard}
    if guard["status"] != "READ_ONLY_OK":
        return result
    host = host_factory()
    try:
        if host.snapshot() != guard["after"]:
            raise ProbeRefused("Document changed before runner")
        if os.path.getsize(config["requests_path"]) > INPUT_LIMIT:
            raise ProbeRefused("Synthetic fixture file too large")
        with open(config["requests_path"], "rb") as stream:
            request_bytes = stream.read()
        requests = json.loads(request_bytes.decode("utf-8-sig"))
        if not isinstance(requests, list) or not 1 <= len(requests) <= 5:
            raise ProbeRefused("Expected 1 to 5 synthetic requests")
        if any(q.get("state", {}).get("meta", {}).get("code") != "SYNTHETIC" for q in requests):
            raise ProbeRefused("D3 probe accepts synthetic fixtures only")
        result["requestsSha256"] = hashlib.sha256(request_bytes).hexdigest()
        result["responses"] = [calculate(q, config["node_executable"], config["runner_path"], 10) for q in requests]
        result["status"] = "SYNTHETIC_REPLAY_OK" if all(r["ok"] for r in result["responses"]) else "ERROR"
    except Exception as exc:
        result.update(status="ERROR", reason=type(exc).__name__ + ": " + str(exc))
    finally:
        result["afterRunner"] = host.snapshot()
        result["documentUnchanged"] = result["afterRunner"] == guard["before"]
        if not result["documentUnchanged"]:
            result.update(status="ERROR", reason="Document changed during runner")
    return result


def d3_entry(inputs):
    if len(inputs) != 3:
        raise ProbeRefused("Expected config, Boolean enabled, nonce")
    canonical_path(inputs[0], ".json")
    if os.path.getsize(inputs[0]) > 65536:
        raise ProbeRefused("Configuration too large")
    with open(inputs[0], "r", encoding="utf-8-sig") as stream:
        config = json.load(stream)
    result = run_d3(config, inputs[1], inputs[2], RevitHost)
    output = config["evidence_jsonl"]
    if os.path.exists(output):
        if os.path.getsize(output) > 10 * 1024 * 1024:
            raise ProbeRefused("Evidence log too large")
        with open(output, "r", encoding="utf-8") as stream:
            for line in stream:
                if line.strip() and json.loads(line).get("schema") != result["schema"]:
                    raise ProbeRefused("Existing output is not D3 evidence")
    with open(output, "a", encoding="utf-8", newline="\n") as stream:
        stream.write(json.dumps(result, ensure_ascii=False, sort_keys=True) + "\n")
    # Keep the Watch compact; the full responses are in the explicit evidence log.
    return json.dumps({k: v for k, v in result.items() if k not in ("guard", "responses", "afterRunner")}, ensure_ascii=False, indent=2)


if "IN" in globals():
    try:
        OUT = d3_entry(IN)
    except Exception as exc:
        OUT = json.dumps({"schema": "keo-dynamo-d3-evidence/v1", "status": "ERROR", "reason": str(exc),
                          "geometryAccepted": False, "normativeAccepted": False}, ensure_ascii=False)
# ----------------------------------------
d3_summary = Watch(d3_synthetic_core_replay)  # graph output
